# Grasshopper definition Bamboo_MCTS.gh (Grasshopper 1.0.7)
# plug-ins: Pug, Anemone

path = FilePath("C:\Users\diego\OneDrive\Projects\Visual Studio\Projects\BambooOptimization\BambooOptimization\export\culms_test_01.json")
panel = Panel(path)
members = Panel("0,0,3,4,1,1,3,4,2,2,3,4,5,5,8,9,6,6,8,9,7,7,8,9,12,13,14,15,12,13,14,15,10,11,10,11")
file = ReadFile(File=path, PerLineParse=False)
path_2 = FilePath("C:\Users\diego\OneDrive\Projects\Visual Studio\Projects\BambooOptimization\BambooOptimization\export\members_test_01.json")
c_script = CSharpScript(
    file=file,
    Reference="C:\Users\diego\OneDrive\Projects\Repos\OneClickLCA_GH\OneClickLCA_GH\packages\Newtonsoft.Json.13.0.1\lib\net45\Newtonsoft.Json.dll")  # -> out, D1, D2, T1, T2, Nodes; inputs file: String
# ---------- c_script: C# usings ----------
using Newtonsoft.Json;
# ---------- c_script: C# ----------
    // input
    List<Culm> culms = JsonConvert.DeserializeObject<List<Culm>>(file);

    // output
    var d1 = new List<int>();
    var d2 = new List<int>();
    var t1 = new List<int>();
    var t2 = new List<int>();
    var nodes = new DataTree<double>();
    for (int i = 0; i < culms.Count; i++)
    {
      d1.Add(culms[i].d1);
      d2.Add(culms[i].d2);
      t1.Add(culms[i].t1);
      t2.Add(culms[i].t2);
      var path = new GH_Path(i);
      nodes.AddRange(culms[i].nodes, path);
    }
    D1 = d1;
    D2 = d2;
    T1 = t1;
    T2 = t2;
    Nodes = nodes;
# ---------- c_script: C# additional code ----------
  public class Culm
  {
    public int id { get; set; }
    public int d1 { get; set; } // diameter 1
    public int d2 { get; set; } // diameter 2
    public int t1 { get; set; } // length before first node
    public int t2 { get; set; } // length after last node
    public List<double> nodes { get; set; }
  }
# ---------- end c_script ----------
panel_2 = Panel(path_2)
file_2 = ReadFile(File=path_2, PerLineParse=False)
culms = Panel("[65,34,74,96,100,23,147,47,89,0,5,11,29,52,102,78,97,59,60,53]")
panel_3 = Panel("""65
34
74
96
100
23
147
47
89
0
5
11
29
52
102
78
97
59
60
53""")
c_script_2 = CSharpScript(
    file=file_2,
    Reference="C:\Users\diego\OneDrive\Projects\Repos\OneClickLCA_GH\OneClickLCA_GH\packages\Newtonsoft.Json.13.0.1\lib\net45\Newtonsoft.Json.dll")  # -> out, ID, S, S0, S1; inputs file: String
# ---------- c_script_2: C# ----------
    // input
    List<Member> members = JsonConvert.DeserializeObject<List<Member>>(file);

    // output
    var id = new List<int>();
    var s = new DataTree<int>();
    var s0 = new DataTree<int>();
    var s1 = new DataTree<int>();
    for (int i = 0; i < members.Count; i++)
    {
      id.Add(members[i].id);
      var path = new GH_Path(i);
      s.AddRange(members[i].s, path);
      s0.AddRange(members[i].s0, path);
      s1.AddRange(members[i].s1, path);
    }
    ID = id;
    S = s;
    S0 = s0;
    S1 = s1;
# ---------- c_script_2: C# additional code ----------
  public class Member
  {
    public int id { get; set; }
    public List<int> s { get; set; }
    public List<int> s0 { get; set; }
    public List<int> s1 { get; set; }
  }
# ---------- end c_script_2 ----------
int = Integer(panel_3)
branch = TreeBranch(Tree=c_script.Nodes, Path=int, MaintainPaths=True)
item = ListItem(List=c_script.T2, Index=int, Wrap=True)  # -> graft(Item)
item_2 = ListItem(List=c_script.D1, Index=int, Wrap=True)  # -> graft(Item)
item_3 = ListItem(List=c_script.D2, Index=int, Wrap=True)  # -> graft(Item)
item_4 = ListItem(List=c_script.T1, Index=int, Wrap=True)  # -> graft(Item)
split = TextSplit(Text=members, Separators=",")
elem = DefineElement(D0=item_2, D1=item_3, T0=item_4, T1=item, Nodes=branch, mode="Bamboo")  # -> flatten(Element)
button = Button()
stock = CreateStock(Elements=elem, mode="Bamboo")
number_slider = Slider(1000, range=0..10000)
create_tree = CTree(Reset=button, Simulations=number_slider, SequenceIndependent=Toggle(False))
panel_4 = Panel("1")
stock_pug = PugObject(stock)
members_int = Integer(split)
panel_5 = Panel("0")
loop_start = LoopStart(N=number_slider, T=button, Tree=create_tree, Stock=stock, Reward="0", Culm="-1")  # -> port, Counter, Data, Stock, Reward, Data_2
lng = ListLength(List=loop_start.Data_2)
subtraction = Subtraction(A=lng, B="1")
item_5 = ListItem(List=split, Index=subtraction, Wrap=True)
int_2 = Integer(item_5)
s_int = Integer(c_script_2.S)
s0_int = Integer(c_script_2.S0)
s1_int = Integer(c_script_2.S1)
lng_2 = ListLength(List=split)
branch_2 = TreeBranch(Tree=c_script_2.S, Path=int_2, MaintainPaths=True)
branch_3 = TreeBranch(Tree=c_script_2.S0, Path=int_2, MaintainPaths=True)
branch_4 = TreeBranch(Tree=c_script_2.S1, Path=int_2, MaintainPaths=True)
subtraction_2 = Subtraction(A=lng_2, B="1")
valid = ValidElements(Stock=loop_start.Stock, S=branch_2, S0=branch_3, S1=branch_4, mode="Bamboo")  # -> Elements, Member
lng_3 = ListLength(List=valid.Elements)
equals = Equality(FirstNumber=lng_3, SecondNumber="0")  # -> Equality, Inequality
equals_2 = Equality(FirstNumber=subtraction, SecondNumber=subtraction_2)  # -> Equality, Inequality
addition = Addition(A=equals_2.Equality, B=equals.Equality)
bool = Boolean(addition)
# MCTS APPROACH
simulate_tree = STreee(
    Tree=loop_start.Data,
    State=loop_start.Data_2,
    Actions=graft(valid.Elements),
    TerminalState=bool,
    Reward=loop_start.Reward)  # -> Tree, ParentState, Action, Done
filter = StreamFilter(Gate=bool, Stream0="-1", Stream1=simulate_tree.ParentState)
gate = StreamGate(Stream=simulate_tree.ParentState, Gate=bool)  # -> Target0, Target1
state_int = Integer(gate.Target1)
lng_4 = ListLength(List=state_int)  # -> expr("x-1", Length)
range = Range(Domain=lng_4, Steps=lng_4)
cull_i = CullIndex(List=state_int, Indices="0", Wrap=True)
lng_5 = ListLength(List=state_int)  # -> expr("x-1", Length)
cull_i_2 = CullIndex(List=range, Indices="-1", Wrap=True)
item_6 = ListItem(List=members_int, Index=cull_i_2, Wrap=True)
# Generate stock and member in case we come from a expansion phase due to a terminal state
int_3 = Integer(item_6)
item_7 = ListItem(List=members_int, Index=lng_5, Wrap=True)
int_4 = Integer(item_7)
branch_5 = TreeBranch(Tree=s0_int, Path=int_3, MaintainPaths=False)
branch_6 = TreeBranch(Tree=s_int, Path=int_3, MaintainPaths=False)
# Very important renumber paths option so the same path can be retrieved several times!
branch_7 = TreeBranch(Tree=s1_int, Path=int_3, MaintainPaths=False)
branch_8 = TreeBranch(Tree=s0_int, Path=int_4, MaintainPaths=False)
branch_9 = TreeBranch(Tree=s_int, Path=int_4, MaintainPaths=False)
branch_10 = TreeBranch(Tree=s1_int, Path=int_4, MaintainPaths=False)
lng_6 = ListLength(List=state_int)
equals_3 = Equality(FirstNumber=lng_6, SecondNumber="1")  # -> Equality, Inequality
valid_2 = ValidElements(Stock=stock_pug, S=branch_6, S0=branch_5, S1=branch_7, mode="Bamboo")  # -> Elements, flatten(Member)
valid_3 = ValidElements(Stock=stock_pug, S=branch_9, S0=branch_8, S1=branch_10, mode="Bamboo")  # -> Elements, Member
filter_2 = StreamFilter(Gate=bool, Stream0=valid.Member, Stream1=valid_3.Member)
entwine = Entwine(Branch00=simulate_tree.ParentState, Branch01=simulate_tree.Action, FlattenInputs=True)  # -> flatten(Result)
update = UpdateStock(Stock=stock_pug, Member=valid_2.Member, ElementIndex=cull_i, mode="Bamboo")  # -> Stock, Reward
filter_3 = StreamFilter(Gate=equals_3.Inequality, Stream0=stock_pug, Stream1=update.Stock)
pug_object = PugObject(filter_3)
filter_4 = StreamFilter(Gate=bool, Stream0=loop_start.Stock, Stream1=pug_object)
update_2 = UpdateStock(Stock=filter_4, Member=filter_2, ElementIndex=simulate_tree.Action, mode="Bamboo")  # -> Stock, Reward
addition_2 = Addition(A=update_2.Reward, B=loop_start.Reward)
filter_5 = StreamFilter(Gate=bool, Stream0=addition_2, Stream1="0")  # -> flatten(Stream)
loop_end = LoopEnd(
    port=loop_start.port,
    Exit=simulate_tree.Done,
    Data=simulate_tree.Tree,
    Stock=update_2.Stock,
    Reward=filter_5,
    Data_2=entwine,
    TimeOutVal=0,
    pausedState=False,
    state="Output last")  # -> Tree, Stock, Reward, Culm
tree_policy = TPolicy(Tree=loop_end.Tree)  # -> flatten(State)
panel_6 = Panel(tree_policy)
heuristic_int = Integer([-1, 5, 14, 5, 14, 1, 15, 1, 15, 19, 2, 2, 15, 10, 3, 14, 3, 17, 8, 14, 17, 4])
mcts_10000_int = Integer([-1, 14, 5, 6, 11, 0, 8, 6, 0, 2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])
mcts_1000_int = Integer([-1, 18, 11, 2, 4, 17, 15, 7, 16, 19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])
mcts_100_int = Integer([-1, 18, 5, 11, 15, 1, 17, 14, 17, 19, 2, 10, 5, 7, 14, 1, 6, 3, 8, 5, 12, 4])
galapagos_int = Integer([-1, 14, 9, 1, 8, 8, 1, 14, 5, 2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])
genes = GenePool(Decimals=0, Maximum=19, Minimum=0, Value=[14, 9, 1, 8, 8, 1, 14, 5, 2, 0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])
completelist_int = Integer(mcts_10000_int)
members_int_2 = Integer(split)
panel_7 = Panel(mcts_1000_int)
# the test sequence must begin with "-1" !!!
testlist_int = Integer(heuristic_int)
panel_8 = Panel("2")
cull_i_3 = CullIndex(List=testlist_int, Indices="0", Wrap=True)
lng_7 = ListLength(List=cull_i_3)  # -> expr("x-1", Length)
# GALAPAGOS APPROACH
galapagos = Galapagos(fitness=num, gene=genes)
# TEST SEQUENCE
panel_9 = Panel(testlist_int)
members_int_3 = Integer(split)
stock_pug_2 = PugObject(stock)
int_5 = Integer(genes)
# HEURISTIC APPROACH
toggle = BooleanToggle(True)
lng_8 = ListLength(List=int_5)
int_6 = Integer(members_int_3)
loop_start_2 = LoopStart(N=lng_7, T=Toggle(True), D0=stock, D1="0")  # -> port, Counter, Data, Data_2
item_8 = ListItem(List=split, Index=loop_start_2.Counter, Wrap=True)
int_7 = Integer(item_8)
branch_11 = TreeBranch(Tree=c_script_2.S, Path=int_7, MaintainPaths=True)
branch_12 = TreeBranch(Tree=c_script_2.S0, Path=int_7, MaintainPaths=True)
branch_13 = TreeBranch(Tree=c_script_2.S1, Path=int_7, MaintainPaths=True)
valid_4 = ValidElements(Stock=loop_start_2.Data, S=branch_11, S0=branch_12, S1=branch_13, mode="Bamboo")  # -> Elements, Member
item_9 = ListItem(List=cull_i_3, Index=loop_start_2.Counter, Wrap=True)
rec = DataRecorder(lng_8, DataLimit=-10, RecordData=True)
lng_9 = ListLength(List=valid_4.Elements)
loop_start_3 = LoopStart(N="36", T=toggle, D0=stock, D1="0", D2="-1")  # -> port, Counter, Data, Data_2, Data_3
item_10 = ListItem(List=members_int_2, Index=loop_start_3.Counter, Wrap=True)
int_8 = Integer(item_10)
branch_14 = TreeBranch(Tree=c_script_2.S, Path=int_8, MaintainPaths=True)
branch_15 = TreeBranch(Tree=c_script_2.S0, Path=int_8, MaintainPaths=True)
branch_16 = TreeBranch(Tree=c_script_2.S1, Path=int_8, MaintainPaths=True)
valid_5 = ValidElements(Stock=loop_start_3.Data, S=branch_14, S0=branch_15, S1=branch_16, mode="Bamboo")  # -> Elements, Member
ma = MassAddition(Input=rec)  # -> Result, PartialResults
equals_4 = Equality(FirstNumber=lng_9, SecondNumber="0")  # -> Equality, Inequality
branch_17 = TreeBranch(Tree=c_script_2.S, Path=int_6, MaintainPaths=False)
branch_18 = TreeBranch(Tree=c_script_2.S0, Path=int_6, MaintainPaths=False)
branch_19 = TreeBranch(Tree=c_script_2.S1, Path=int_6, MaintainPaths=False)
update_3 = UpdateStock(Stock=loop_start_2.Data, Member=valid_4.Member, ElementIndex=item_9, mode="Bamboo")  # -> Stock, Reward
equals_5 = Equality(FirstNumber=update_3.Reward, SecondNumber="0")  # -> Equality, Inequality
count_iterations = Panel(ma.Result)
update_4 = UpdateStock(Stock=loop_start_3.Data, Member=valid_5.Member, ElementIndex=graft(valid_5.Elements), mode="Bamboo")  # -> Stock, flatten(Reward)
sort = SortList(Keys=update_4.Reward, ValuesA=valid_5.Elements)  # -> Keys, reverse(ValuesA)
addition_3 = Addition(A=equals_5.Equality, B=equals_4.Equality)
addition_4 = Addition(A=loop_start_2.Data_2, B=update_3.Reward)
valid_6 = ValidElements(Stock=stock_pug_2, S=branch_17, S0=branch_18, S1=branch_19, mode="Bamboo")  # -> Elements, flatten(Member)
item_11 = ListItem(List=sort.ValuesA, Index=0, Wrap=True)
update_5 = UpdateStock(Stock=loop_start_3.Data, Member=valid_5.Member, ElementIndex=item_11, mode="Bamboo")  # -> Stock, Reward
update_6 = UpdateStock(Stock=stock_pug_2, Member=valid_6.Member, ElementIndex=int_5, mode="Bamboo")  # -> Stock, Reward
bool_2 = Boolean(addition_3)
loop_end_2 = LoopEnd(
    port=loop_start_2.port,
    Exit=bool_2,
    Data=update_3.Stock,
    Data_2=addition_4,
    TimeOutVal=0,
    pausedState=False,
    state="Last & Record")  # -> D0, flatten(D1)
addition_5 = Addition(A=loop_start_3.Data_2, B=update_5.Reward)
ma_2 = MassAddition(Input=loop_end_2.D1)  # -> Result, PartialResults
lng_10 = ListLength(List=valid_5.Elements)
num = Number(update_6.Reward)
num_2 = Number(ma_2.Result)
entwine_2 = Entwine(Branch00="-1", Branch01=int_5, FlattenInputs=True)  # -> flatten(Result)
equals_6 = Equality(FirstNumber=lng_10, SecondNumber="0")  # -> Equality, Inequality
equals_7 = Equality(FirstNumber=update_5.Reward, SecondNumber="0")  # -> Equality, Inequality
testgalapagos_int = Integer(entwine_2)
addition_6 = Addition(A=equals_7.Equality, B=equals_6.Equality)
panel_11 = Panel(loop_end_2.D1)
bool_3 = Boolean(addition_6)
loop_end_3 = LoopEnd(
    port=loop_start_3.port,
    Exit=bool_3,
    Data=update_5.Stock,
    Data_2=addition_5,
    Data_3=item_11,
    TimeOutVal=0,
    pausedState=False,
    state="Last & Record")  # -> D0, flatten(D1), flatten(D2)
cull_i_4 = CullIndex(List=loop_end_3.D1, Indices="-1", Wrap=True)
cull_i_5 = CullIndex(List=loop_end_3.D2, Indices="-1", Wrap=True)
entwine_3 = Entwine(Branch00="-1", Branch01=cull_i_5, FlattenInputs=True)  # -> flatten(Result)
panel_12 = Panel(cull_i_5)
panel_13 = Panel(cull_i_4)
