# Grasshopper definition Truss_SLAgent_train.gh (Grasshopper 1.0.7)
# plug-ins: Pug, Owl.GH

panel = Panel("""28
28
3""")
keras_layer = KerasLayer(Shape=panel, mode="Input Layer")
keras_layer_2 = KerasLayer(Parent=keras_layer, Filters=Slider(32, range=0..100), mode="Conv2D Layer")
panel_2 = Panel("""28
28
3""")
panel_3 = Panel("""1
1""")
panel_4 = Panel("""3
3""")
keras_layer_3 = KerasLayer(Shape=panel_2, mode="Input Layer")
keras_layer_4 = KerasLayer(Parent=keras_layer_2, PoolSize=panel_4, Stride=panel_3, mode="MaxPooling2D Layer")
keras_layer_5 = KerasLayer(Parent=keras_layer_3, mode="Flatten Layer")
list = ValueList({"None": 0, "ReLu": 1, "Sigmoid": 2, "Softmax": 3, "Tanh": 4}, selected="ReLu")
keras_layer_6 = KerasLayer(Parent=keras_layer_4, mode="Flatten Layer")
list_2 = ValueList({"None": 0, "ReLu": 1, "Sigmoid": 2, "Softmax": 3, "Tanh": 4}, selected="ReLu")
keras_layer_7 = KerasLayer(Parent=keras_layer_5, Size=Slider(64, range=0..1000), Activator=list, mode="Dense Layer")
keras_layer_8 = KerasLayer(Parent=keras_layer_6, Size=Slider(64, range=0..1000), Activator=list_2, mode="Dense Layer")
list_3 = ValueList({"None": 0, "ReLu": 1, "Sigmoid": 2, "Softmax": 3, "Tanh": 4}, selected="ReLu")
list_4 = ValueList({"None": 0, "ReLu": 1, "Sigmoid": 2, "Softmax": 3, "Tanh": 4}, selected="ReLu")
path = FilePath("C:\Users\diego\OneDrive\Dissertation\LaTeX\5\scripts\tensors_trusses_2.txt")
keras_layer_9 = KerasLayer(Parent=keras_layer_7, Size=Slider(64, range=0..1000), Activator=list_3, mode="Dense Layer")
keras_layer_10 = KerasLayer(Parent=keras_layer_8, Size=Slider(64, range=0..1000), Activator=list_4, mode="Dense Layer")
file = ReadFile(File=path, PerLineParse=True)
path_2 = FilePath("C:\Users\diego\OneDrive\Dissertation\LaTeX\5\scripts\rewards_trusses_2.txt")
split = TextSplit(Text=file, Separators=",")
file_2 = ReadFile(File=path_2, PerLineParse=True)
list_5 = ValueList({"None": 0, "ReLu": 1, "Sigmoid": 2, "Softmax": 3, "Tanh": 4}, selected="None")
list_6 = ValueList({"None": 0, "ReLu": 1, "Sigmoid": 2, "Softmax": 3, "Tanh": 4}, selected="None")
panel_5 = Panel("""28
28
3""")
split_2 = TextSplit(Text=file_2, Separators=",")
keras_layer_11 = KerasLayer(Parent=keras_layer_10, Size=Slider(1, range=0..10), Activator=list_6, mode="Dense Layer")
keras_layer_12 = KerasLayer(Parent=keras_layer_9, Size=Slider(1, range=0..10), Activator=list_5, mode="Dense Layer")
bnd = Bounds(Numbers=split_2)
tensor = ConstructTensor(Values=flatten(split), Shape=panel_5)
lng = ListLength(List=split_2)  # -> expr("x-1", Length)
remap = RemapNumbers(Value=split_2, Source=bnd, Target=Domain(0, 1))  # -> Mapped, Clipped
keras_model = KerasModel(Layer=keras_layer_11, Name="ConvolutionalNeuralNetwork", LearningRate=0.001)
range = Range(Domain=lng, Steps=lng)
keras_model_2 = KerasModel(Layer=keras_layer_12, Name="FullyConnectedNeuralNetwork", LearningRate=0.001)
partition = PartitionList(List=split, Size=Slider(2352, range=0..10000))
tensor_2 = ConstructTensor(Values=flatten(remap.Mapped), Shape="1")
number_slider = Slider(248, range=0..248)
number_slider_2 = Slider(72, range=0..1000)
viewer = ParamViewer(partition)
sort = SortList(Keys=split_2, ValuesA=range)  # -> Keys, ValuesA
panel_6 = Panel("""28
28
3""")
item = ListItem(List=viewer, Index=number_slider_2, Wrap=True)
branch = TreeBranch(Tree=partition, Path=item, MaintainPaths=True)
partition_2 = PartitionList(List=branch, Size=Slider(784, range=0..1000))  # -> simplify(Chunks)
item_2 = ListItem(List=remap.Mapped, Index=number_slider_2, Wrap=True)
flip = FlipMatrix(Data=partition_2)

# ---- group: Second Button
button = Button()

# ----
viewer_2 = ParamViewer(flip)
pug_object = PugObject(keras_model)
pug_object_2 = PugObject(keras_model_2)
partition_3 = PartitionList(List=reverse(viewer_2), Size="28")
sl = SLAgent(
    Run=button,
    X=tensor,
    Y=tensor_2,
    ANN=pug_object_2,
    BatchSize=Slider(16, range=0..100),
    Epochs=Slider(5, range=0..10),
    ValidationSplit=Slider(0.1, range=0..0.1),
    mode="Regression")  # -> Agent, MeanAbsoluteError
flip_2 = FlipMatrix(Data=partition_3)  # -> flatten(Data)
num = Number(partition_2)
panel_7 = Panel("""28
28
3""")
num_2 = Number(sl.MeanAbsoluteError)
tensor_3 = ConstructTensor(Values=flatten(num), Shape=panel_7)
branch_2 = TreeBranch(Tree=flip, Path=flip_2, MaintainPaths=False)
tensor_4 = ConstructTensor(Values=flatten(branch_2))
reshape = Reshape(Tensor=tensor_4, Shape=panel_6)
num_3 = Number(item_2)
pug_object_3 = PugObject(sl.Agent)
T = Tensor(reshape)
graph = QuickGraph(sl.MeanAbsoluteError, SortOrder=0)
_2dpreview = Tensor2DPreview(Tensor=T, Range="0 to 1", SaveAll=False)
predict = PredictData(Agent=pug_object_3, X=tensor_3, mode="Regression")
domain = Domain(bnd)
remap_2 = RemapNumbers(Value=num_3, Source=Domain(0, 1), Target=domain)  # -> Mapped, Clipped
remap_3 = RemapNumbers(Value=predict, Source=Domain(0, 1), Target=domain)  # -> Mapped, Clipped
panel_8 = Panel(num_2)
actual_gwp_kg_co2e = Panel(remap_2.Mapped)
predected_gwp_kg_co2e = Panel(remap_3.Mapped)
num_4 = Number([0.4762848616, 5.307985783, 4.080148697, 3.105430841, 2.633858204, 2.231291533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])
panel_9 = Panel("GWP [kg CO2]")
