# Grasshopper definition SteelTrussAgent.gh (Grasshopper 1.0.7)
# plug-ins: Anemone, Karamba3D, Pug, Beaver, One Click LCA

number_slider = Slider(3, range=0..10)
button = Button()
number_slider_2 = Slider(50, range=0..100)
number_slider_3 = Slider(10, range=0..10)
path = FilePath("C:\Users\diego\OneDrive\Dissertation\LaTeX\5\scripts\DQN__Model.hd5")
number_slider_4 = Slider(15, range=0..100)
number_slider_5 = Slider(10, range=0..10)
multiplication = Multiplication(A="0.2", B=number_slider_4)
division = Division(A=number_slider_4, B="10")
pt = Point("0,0")
range = Range(Domain=number_slider_4, Steps=Slider(16, range=0..100))
panel = Panel("0")
lng = ListLength(List=range)
number_slider_6 = Slider(100, range=0..1000)  # disabled
neg = Negative(Value=Slider(3, range=0..10))
subtraction = Subtraction(A=lng, B="4")
dqn = DQNAgent(Reset=button, Input=subtraction, Output=Slider(2, range=0..10), Hidden=Slider(50, range=0..100))
loop_start = LoopStart(N=number_slider_2, T=button, D0=dqn)  # -> port, Counter, Data, Data_2
remap = RemapNumbers(Value=loop_start.Counter, Source=number_slider_2, Target=Domain(0, 1))  # -> Mapped, Clipped
loop_start_2 = LoopStart(N=Slider(20, range=0..100), T=loop_start.Counter, D0=loop_start.Data, D1=pt, D2="0", D3="0")  # -> port, Counter, Data, Data_2, Data_3, Data_4, Data_5
clean = CleanTree(RemoveNulls=True, RemoveInvalid=True, RemoveEmpty=False, Tree=loop_start_2.Data_5)
graph = GraphMapper(remap.Mapped, x0=0, x1=1, y0=0, y1=1, container_name="Bezier", cpx=[0, 0, 0.3277897537, 1], cpy=[1, 0.2327398658, 0, 0])
panel_2 = Panel("3")
sleep = SleepThread(Trigger=loop_start_2.Counter, SleepTime=number_slider_6)  # disabled
int = Integer(clean)
pt_2 = Point(flatten(loop_start_2.Data_2))
panel_3 = Panel("If((x=5) and (y=1),1,0)")
addition = Addition(A=loop_start_2.Data_3, B="1")
panel_4 = Panel("If((x=3) and (y=1),1,0)")
division_2 = Division(A=range, B=number_slider_4)
lng_2 = ListLength(List=division_2)
subtraction_2 = Subtraction(A=lng_2, B="4")
lng_3 = ListLength(List=division_2)
subtraction_3 = Subtraction(A=lng_3, B="3")
panel_5 = Panel("5000")  # disabled
lng_4 = ListLength(List=division_2)
sleep_2 = SleepThread(Trigger=loop_start_2.Counter, SleepTime=panel_5)  # disabled
cluster = Cluster_4(int=subtraction, int_2=int)
panel_6 = Panel(cluster)
subtraction_4 = Subtraction(A=lng_4, B="3")
panel_7 = Panel("If((x=4) and (y=0),1,0)")
panel_8 = Panel("If((x=4) and (y=1),1,0)")
lng_5 = ListLength(List=division_2)
panel_9 = Panel(graph)
subtraction_5 = Subtraction(A=lng_5, B="2")
lng_6 = ListLength(List=pt_2)
kgco2e_m = Panel("266.4")
kgco2e_m_2 = Panel("6.0")
kgco2e_m_3 = Panel("96.4")
panel_10 = Panel("""-3
-2
-1""")
mod = Modulus(A=lng_6, B="2")
int_2 = Integer(mod)
panel_11 = Panel("""-2
-1""")
concat = Concatenate(FragmentA="If((x=", FragmentB=subtraction_2, FragmentC=") and (y=1),1,0)")
X = UnitX(Factor=number_slider_4)
tensor = ConstructTensor(Values=flatten(cluster), Shape=subtraction)
int_3 = Integer(mod)
int_4 = Integer(mod)
int_5 = Integer(mod)
concat_2 = Concatenate(FragmentA="If((x=", FragmentB=subtraction_3, FragmentC=") and (y=1),1,0)")
item = ListItem(List=range, Index="-1", Wrap=True)
elem = DefineElement(CrossSsection="25x6", Material="GL24h", Length=Slider(14, range=0..100), Weight=kgco2e_m_2, mode="Steel")
elem_2 = DefineElement(CrossSsection="HEA260", Material="S355", Length=Slider(100, range=0..100), Weight=kgco2e_m, mode="Steel")
item_2 = ListItem(List=division_2, Index="-1", Wrap=True)
elem_3 = DefineElement(CrossSsection="HEA140", Material="S355", Length=Slider(15, range=0..100), Weight=kgco2e_m_3, mode="Steel")
concat_3 = Concatenate(FragmentA="If((x=", FragmentB=subtraction_4, FragmentC=") and (y=0),1,0)")
item_3 = ListItem(List=range, Index=panel_11, Wrap=True)
item_4 = ListItem(List=division_2, Index=panel_11, Wrap=True)
panel_13 = Panel("n=5; a=1")
item_5 = ListItem(List=range, Index="-1", Wrap=True)
item_6 = ListItem(List=division_2, Index="-1", Wrap=True)
concat_4 = Concatenate(FragmentA="If((x=", FragmentB=subtraction_5, FragmentC=") and (y=1),1,0)")
item_7 = ListItem(List=range, Index=panel_10, Wrap=True)
item_8 = ListItem(List=division_2, Index=panel_10, Wrap=True)
panel_14 = Panel("""0
0""")
move = Move(Geometry=pt, Motion=X)  # -> Geometry, Transform
panel_15 = Panel("""0
0
0""")
panel_16 = Panel("n=4; a=0")
panel_17 = Panel("""1
0""")
panel_18 = Panel("n=4; a=1")
# Complete truss nodes when there's no other possibility
panel_19 = Panel("n=3; a=1")
panel_20 = Panel("""0
1
0""")
cluster_2 = Cluster_3(graph=item_2)
cluster_3 = Cluster_3(graph=item_4)
cluster_4 = Cluster_3(graph=item_6)
cluster_5 = Cluster_3(graph=item_8)
action = DQNChooseAction(DQNAgent=loop_start_2.Data, State=tensor, Ε=panel_9)
p_n_c = PickNChoose(Pattern="0", Stream0="0", Stream1=cluster_2)
multiplication_2 = Multiplication(A=p_n_c, B=neg)
addition_2 = Addition(A=addition, B="1")
p_n_c_2 = PickNChoose(Pattern=panel_17, Stream0=panel_14, Stream1=cluster_3)
multiplication_3 = Multiplication(A=p_n_c_2, B=neg)
p_n_c_3 = PickNChoose(Pattern="0", Stream0="0", Stream1=cluster_4)
multiplication_4 = Multiplication(A=p_n_c_3, B=neg)
p_n_c_4 = PickNChoose(Pattern=panel_20, Stream0=panel_15, Stream1=cluster_5)
multiplication_5 = Multiplication(A=p_n_c_4, B=neg)
pt_3 = ConstructPoint(XCoordinate=item, YCoordinate=0, ZCoordinate=multiplication_2)
pug_object = PugObject([elem, elem_3, elem_2])
int_6 = Integer(cluster)
pt_4 = ConstructPoint(XCoordinate=item_3, YCoordinate=0, ZCoordinate=multiplication_3)
pt_5 = ConstructPoint(XCoordinate=item_5, YCoordinate=0, ZCoordinate=multiplication_4)
pt_6 = ConstructPoint(XCoordinate=item_7, YCoordinate=0, ZCoordinate=multiplication_5)
ma = MassAddition(Input=int_6)  # -> Result, PartialResults
filter = StreamFilter(Gate=action, Stream0=addition, Stream1=addition_2)
int_7 = Integer(filter)
int_8 = Integer(filter)
int_9 = Integer(filter)
int_10 = Integer(filter)
eval = Evaluate(F=concat_4, x=int_7, y=int_2)
eval_2 = Evaluate(F=concat_3, x=int_8, y=int_3)
eval_3 = Evaluate(F=concat_2, x=int_9, y=int_4)
eval_4 = Evaluate(F=concat, x=int_10, y=int_5)
item_9 = ListItem(List=division_2, Index=filter, Wrap=True)  # -> Item, Item1
cluster_6 = Cluster_3(graph=item_9.Item)
multiplication_6 = Multiplication(A=item_9.Item, B=number_slider_4)
multiplication_7 = Multiplication(A=neg, B=cluster_6)
merge = Merge(Data1=division, Data2=item_9.Item)  # -> flatten(Result)
filter_2 = StreamFilter(Gate=mod, Stream0="0", Stream1=multiplication_7)
equals = Equality(FirstNumber=eval, SecondNumber="0")  # -> Equality, Inequality
equals_2 = Equality(FirstNumber=eval_2, SecondNumber="0")  # -> Equality, Inequality
equals_3 = Equality(FirstNumber=eval_3, SecondNumber="0")  # -> Equality, Inequality
equals_4 = Equality(FirstNumber=eval_4, SecondNumber="0")  # -> Equality, Inequality
pt_7 = ConstructPoint(XCoordinate=multiplication_6, YCoordinate=0, ZCoordinate=filter_2)
merge_2 = Merge(Data1=division, Data2=item_9.Item1)  # -> flatten(Result)
merge_3 = Merge(Data1=pt_2, Data2=pt_7)  # -> flatten(Result)
entwine = Entwine(Branch00=int, Branch01=action, FlattenInputs=True)  # -> flatten(Result)
filter_3 = StreamFilter(Gate=equals.Inequality, Stream1=pt_3)
state = State(int=entwine)
filter_4 = StreamFilter(Gate=equals_2.Inequality, Stream1=pt_4)
filter_5 = StreamFilter(Gate=equals_3.Inequality, Stream1=pt_5)
filter_6 = StreamFilter(Gate=equals_4.Inequality, Stream1=pt_6)
larger = LargerThan(FirstNumber=ma.Result, SecondNumber="4")  # -> LargerThan, OrEqualTo
cluster_7 = Cluster_4(int=subtraction, int_2=entwine)
subtraction_6 = Subtraction(A=ma.Result, B="4")
addition_3 = Addition(A=equals_4.Inequality, B=equals_3.Inequality, C=equals_2.Inequality, D=equals.Inequality)
panel_24 = Panel(addition_3)
tensor_2 = ConstructTensor(Values=flatten(cluster_7), Shape=subtraction)
rec = DataRecorder(action, DataLimit=-10, RecordData=True)  # disabled
bool = Boolean(addition_3)
and = GateAnd(A=larger.LargerThan, B=bool)
path_2 = FilePath("C:\Users\diego\OneDrive\Dissertation\LaTeX\5\scripts\")
panel_25 = Panel(rec)  # disabled
entwine_2 = Entwine(Branch00=filter_6, Branch01=filter_5, Branch02=filter_4, Branch03=filter_3, FlattenInputs=True)  # -> flatten(Result)
pt_8 = Point(entwine_2)
entwine_3 = Entwine(Branch00=merge_3, Branch01=pt_8, FlattenInputs=True)  # -> flatten(Result)
gate = StreamGate(Stream=entwine_3, Gate=and)  # -> Target0, Target1
cluster_8 = Cluster(G=pt, F=number_slider_4, pt=gate.Target1)
cluster_9 = Cluster_2(pug_object=pug_object, crv=cluster_8, pos_ind=pt, pos_ind_2=move.Geometry)
num = Number(cluster_9)
bool_2 = Boolean(num)
division_3 = Division(A=num, B="2000")
subtraction_7 = Subtraction(A="1", B=division_3)
filter_7 = StreamFilter(Gate=bool_2, Stream0="0", Stream1=subtraction_7)
crv = Curve(cluster_8)
n12_txt = Text(["0.46154", "0.43464", "0.395109", "0.349162", "0.432624", "0.366044", "0.452359", "0.452359", "0.452153", "0.452153", "0.366044", "0.366044", "0.479247", "0.452153", "0.452153", "0.451474", "0.452153", "0.43464", "0.45121", "0.452153", "0.452153", "0.452153", "0.452359", "0.45121", "0.34155", "0.395109", "0.34155", "0.34155", "0.34155", "0.452153", "0.452153", "0.452359", "0.327334", "0.327334", "0.452153", "0.452153", "0.314643", "0.34621", "0.452153", "0.314643", "0.282197", "0.452153", "0.452153", "0.452359", "0.314643", "0.46154", "0.452153", "0.452359", "0.452359", "0.452359", "0.452359"])
n16_txt = Text(["-1", "-3", "-1", "-1", "-1", "0", "-1", "0", "-1", "0.211307", "0.208257", "0.193099", "0.212041", "0.28982", "0.28982", "0.219747", "0.28982", "0.219747", "0.28982", "0.28982", "0.28982", "-4", "-4", "-4", "0.28982", "0.209855", "0.28982", "0.28982", "0.28982", "0.28982", "0.208043", "0.28982", "0.28982", "0.28982", "0.212519", "0.28982", "0.28982", "0.28982", "0.28982", "0.28982", "0.28982", "0.28982", "0.28982", "0.28982", "0.208257", "0.28982", "0.28982", "0.28982", "0.28982", "0.28982", "0.212519"])
crv_2 = Curve([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])
crv_3 = Curve([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])
filter_8 = StreamFilter(Gate=Slider(1, range=0..1), Stream0=crv_3, Stream1=crv_2)
len = Length(Curve=crv_3)
len_2 = Length(Curve=crv_2)
ma_2 = MassAddition(Input=len)  # -> Result, PartialResults
ma_3 = MassAddition(Input=len_2)  # -> Result, PartialResults
panel_26 = Panel(ma_2.Result)
panel_27 = Panel(ma_3.Result)
division_4 = Division(A="1100", B=16)
matprops = MaterialPropertiesKaramba3D(
    FamilyOfMaterial="Steel",
    Name="Timber",
    YoungsModulus_kN_cm2="1100",
    InPlaneShearModulus_kN_cm2=division_4,
    TransverseShearModulus_kN_cm2=division_4,
    SpecificWeight_kN_m3="3.8",
    CoefficientOfThermalExpansion_1_C=1e-05,
    YieldStrength_kN_cm2="2.4",
    mode="Isotrop")
license = LicenseKaramba3D()
matselect = MaterialSelectionKaramba3D(menu=[dropdown(1), dropdown(2)])
midpt = CurveMiddle(Curve=crv)
panel_28 = Panel("25x6")
Z = UnitZ(Factor=Slider(20, range=0..100))
rev = Reverse(Vector=Z)
pt_9 = Point("3,0,3")
crosecrselect = CrossSectionRangeSelectorKaramba3D(MaximumHeight_cm=-1, MaximumWidth_cm=-1, Material=matselect, menu=[dropdown(1), dropdown(1), dropdown(3)])
supp = SupportKaramba3D(PosInd=pt, menu=[buttons(on, on, on, on, off, on)])
supp_2 = SupportKaramba3D(PosInd=move.Geometry, menu=[buttons(off, off, on, on, off, on)])
pdecon = Deconstruct(Point=midpt)  # -> XComponent, YComponent, ZComponent
crosecrselect_2 = CrossSectionRangeSelectorKaramba3D(MaximumHeight_cm=-1, MaximumWidth_cm=-1, Material=matselect, menu=[dropdown(1), dropdown(2), dropdown(3)])
loads = LoadsKaramba3D(ForceVector=rev, Local=False, PosInd=pt_9, LCase="0", mode="Point")
midpt_2 = CurveMiddle(Curve=crv)
equals_5 = Equality(FirstNumber=pdecon.ZComponent, SecondNumber="0")  # -> Equality, Inequality
panel_29 = Panel("""HEA140
HEA260""")
item_10 = ListItem(List=crosecrselect_2, Index="10", Wrap=True)
pdecon_2 = Deconstruct(Point=midpt_2)  # -> XComponent, YComponent, ZComponent
toggle = BooleanToggle(False)
crosecselect = CrossSectionSelectorKaramba3D(CrossSections=crosecrselect, NameOrListIndexOfCrossSection=panel_29, ElementsIdentifiers="Loaded")  # -> flatten(CrossSection), Info
beam_loads = BeamLoadsKaramba3D(BeamIdentifier="Loaded", LoadCase="0", ForceVector=rev, TStart=0, TEnd=1, mode="Block", menu=[buttons(off, on, off)])
dispatch = Dispatch(List=crv, DispatchPattern=equals_5.Equality)  # -> ListA, ListB

width_cm = Slider(6, range=4..14)
number_slider_7 = Slider(25, range=6..50)
cross_section = CrossSectionKaramba3D(
    FamilyNameOfCrossSection="DefaultCroSec",
    Material=matprops,
    Height_cm=number_slider_7,
    UpperFlangeWidth_cm=width_cm,
    LowerFlangeWidth_cm=width_cm,
    mode="Trapezoid")
linetobeam = LineToBeamKaramba3D(Line=dispatch.ListA, Identifier="Loaded", CrossSection=cross_section, New=True, Remove=True, LimitDistance_m=0.005)  # -> Element, Points, Info

width_cm_2 = Slider(6, range=4..14)
number_slider_8 = Slider(25, range=6..50)
cross_section_2 = CrossSectionKaramba3D(
    FamilyNameOfCrossSection="DefaultCroSec",
    Material=matprops,
    Height_cm=number_slider_8,
    UpperFlangeWidth_cm=width_cm_2,
    LowerFlangeWidth_cm=width_cm_2,
    mode="Trapezoid")
linetobeam_2 = LineToBeamKaramba3D(Line=dispatch.ListB, Identifier="Unloaded", CrossSection=cross_section_2, New=True, Remove=True, LimitDistance_m=0.005)  # -> Element, Points, Info

equals_6 = Equality(FirstNumber=pdecon_2.ZComponent, SecondNumber="0")  # -> Equality, Inequality
pug_object_2 = PugObject(pug_object)
item_11 = ListItem(List=crosecselect.CrossSection, Index="1", Wrap=True)
stock = CreateStock(Elements=pug_object_2, mode="Steel")  # -> Stock, CrossSections
entwine_4 = Entwine(Branch00=item_10, Branch01=crosecselect.CrossSection, FlattenInputs=True)  # -> flatten(Result)
dispatch_2 = Dispatch(List=crv, DispatchPattern=equals_6.Equality)  # -> ListA, ListB
linetobeam_3 = LineToBeamKaramba3D(
    Line=dispatch_2.ListB,
    Identifier="Unloaded",
    CrossSection=item_11,
    New=True,
    Remove=True,
    LimitDistance_m=0.005,
    Bending=Toggle(True),
    SetBucklingLength=True,
    ToPolylineMaxAngle=0.03,
    ToPolylineTolerance=0.01,
    ToPolylineMinEdgeLength=0.25)  # -> Element, Points, Info
linetobeam_4 = LineToBeamKaramba3D(
    Line=dispatch_2.ListA,
    Identifier="Loaded",
    CrossSection=item_11,
    New=True,
    Remove=True,
    LimitDistance_m=0.005,
    Bending=Toggle(True),
    SetBucklingLength=True,
    ToPolylineMaxAngle=0.03,
    ToPolylineTolerance=0.01,
    ToPolylineMinEdgeLength=0.25)  # -> Element, Points, Info
assemble = AssembleModelKaramba3D(
    Elem=flatten([linetobeam_4.Element, linetobeam_3.Element]),
    Support=[supp, supp_2],
    Load=beam_loads,
    LimitDistance_m=0.005)  # -> Model, Info, Mass_kg, CenterOfGravity, LoadCaseNames
dispatch_3 = Dispatch(List=crv, DispatchPattern=[True, False])  # -> ListA, ListB
panel_30 = Panel("Unloaded")
disassemble = DisassembleCrossSectionKaramba3D(CroSec=crosecselect.CrossSection)  # -> CrossSection, FamilyNameOfCrossSection, TypeNameOfCrossSection, ElemIdentifiers, Color, Material, LocalEccentricity_cm, Heights_cm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
analyze = AnalyzeKaramba3D(Model=assemble.Model)  # -> CalculatedModel, MaximumDisplacement_cm, ResultingForceOfGravity_kN, ElasticEnergyChange_kNm
opticrosec = OptimizeCrossSectionKaramba3D(
    Model=analyze.CalculatedModel,
    CrossSections=entwine_4,
    MaximumUtilization=1,
    UltimateLimitStateIterations=5,
    DisplacementIterations=5,
    NumberOfSamplePoints=3,
    ElasticDesign=True,
    GammaM0=1,
    GammaM1=1.1,
    SwayFrame=True)  # -> ModelWithOptimizedCrossSections, Info, Mass_kg, MaximumDisplacement_cm, ElasticEnergyChange_kNm
len_3 = TextLength(Text=opticrosec.Info)
larger_2 = LargerThan(FirstNumber=len_3, SecondNumber="0")  # -> LargerThan, OrEqualTo
Z_2 = UnitZ(Factor=Slider(20, range=0..100))
utilization = UtilizationOfElementsKaramba3D(
    AnalyzedModel=opticrosec.ModelWithOptimizedCrossSections,
    NumberOfSamplePoints=3,
    ElasticDesign=True,
    GammaM0=1,
    GammaM1=1.1,
    SwayFrame=True,
    WithDetails=False,
    mode="Beams")  # -> AnalyzedModel, Utilization, SigMax_kN_cm2, SigMin_kN_cm2, TauMax_kN_cm2, UtilN, UtilVy, UtilVz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
rev_2 = Reverse(Vector=Z_2)
disassemble_2 = DisassembleModelKaramba3D(Model=opticrosec.ModelWithOptimizedCrossSections)  # -> Model, Point, Beam, Shell, Support, Load, Line, Mesh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
pt_10 = Point("3,0,3")
supp_3 = SupportKaramba3D(PosInd=pt, menu=[buttons(on, on, on, on, off, on)])
supp_4 = SupportKaramba3D(PosInd=move.Geometry, menu=[buttons(off, off, on, on, off, on)])
loads_2 = LoadsKaramba3D(ForceVector=rev_2, Local=False, PosInd=pt_10, LCase="0", mode="Point")
modelview = ModelViewKaramba3D(Model=opticrosec.ModelWithOptimizedCrossSections, ResultFactors=1, ResultCase=-1)  # -> Model, DeformedMesh, DeformedAxes, DeformedModel
entwine_5 = Entwine(Branch00=cross_section, Branch01=crosecselect.CrossSection, FlattenInputs=True)  # -> flatten(Result)
panel_31 = Panel(opticrosec.Info)
disassemble_3 = DisassembleElementKaramba3D(Element=disassemble_2.Beam)  # -> Element, ElementIdentifier, AxisOfElement, CrossSection, Joint, Material, LocalCoordinateSystem, ElementIsActive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
beamview = BeamViewKaramba3D(Model=modelview.Model)  # -> Model, MeshesOfRenderedBeams, DeformedBeamAxes, LegendColors, LegendTags
disassemble_4 = DisassembleCrossSectionKaramba3D(CroSec=disassemble_3.CrossSection)  # -> CrossSection, FamilyNameOfCrossSection, TypeNameOfCrossSection, ElemIdentifiers, Color, Material, LocalEccentricity_cm, Heights_cm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
mindex = MemberIndex(Set=panel_29, Member=disassemble_4.TypeNameOfCrossSection)  # -> flatten(Index), Count
addition_4 = Addition(A=mindex.Index, B="1")
lng_7 = ListLength(List=addition_4)
repeat = RepeatData(Data="0", Length=lng_7)
beam_loads_2 = BeamLoadsKaramba3D(BeamIdentifier="Loaded", LoadCase="0", ForceVector=rev_2, TStart=0, TEnd=1, mode="Block", menu=[buttons(off, on, off)])
linetobeam_5 = LineToBeamKaramba3D(
    Line=dispatch.ListB,
    Identifier="Unloaded",
    CrossSection=item_11,
    New=True,
    Remove=True,
    LimitDistance_m=0.005,
    Bending=Toggle(True),
    SetBucklingLength=True,
    ToPolylineMaxAngle=0.03,
    ToPolylineTolerance=0.01,
    ToPolylineMinEdgeLength=0.25)  # -> Element, Points, Info
assemble_2 = AssembleModelKaramba3D(
    Elem=flatten([linetobeam.Element, linetobeam_2.Element]),
    Support=[supp_3, supp_4],
    Load=beam_loads_2,
    LimitDistance_m=0.005)  # -> Model, Info, Mass_kg, CenterOfGravity, LoadCaseNames
multiplication_8 = Multiplication(A="30680", B=disassemble_4.Area_cm2)
division_5 = Division(A=multiplication_8, B="10000")
analyze_2 = AnalyzeKaramba3D(Model=assemble_2.Model)  # -> CalculatedModel, MaximumDisplacement_cm, ResultingForceOfGravity_kN, ElasticEnergy_kNm
modelview_2 = ModelViewKaramba3D(Model=analyze_2.CalculatedModel, ResultFactors=1, ResultCase=-1)  # -> Model, DeformedMesh, DeformedAxes, DeformedModel
kgco2e_m_4 = Panel(division_5)
b_forces = BeamForcesKaramba3D(AnalyzedModel=modelview_2.Model, MaximumDistanceBetweenResults_m=-1, NumberOfResultsPerBeamElement=6)  # -> AnalyzedModel, simplify(NormalForce_kN), simplify(ShearForceVz_kN), simplify(ShearForceVy_kN), simplify(BendingMomentMt_kNm), simplify(BendingMomentMy_kNm), simplify(BendingMomentMz_kNm)
type = ValueList({"GL 24h", "GL 28h", "GL 32h", "GL 24c", "GL 28c", "GL 32c"}, selected="GL 24h")
beamview_2 = BeamViewKaramba3D(Model=modelview_2.Model)  # -> Model, MeshesOfRenderedBeams, DeformedBeamAxes, LegendColors, LegendTags
weave = Weave(Pattern=graft(equals_5.Equality), Stream0=width_cm_2, Stream1=width_cm, NullGaps=False)  # -> flatten(Weave)
weave_2 = Weave(Pattern=graft(equals_5.Equality), Stream0=number_slider_8, Stream1=number_slider_7, NullGaps=False)  # -> flatten(Weave)
bending_normal = BendingAndNormalForcesGeneral(
    Nd=b_forces.NormalForce_kN,
    Myd=b_forces.BendingMomentMy_kNm,
    Mzd=0,
    Base=graft(weave),
    Heigth=graft(weave_2),
    BucklingLengthY=0,
    BucklingLengthZ=0,
    EffectiveLengthAsARatioOfTheSpan=1,
    ModificationFactor=0.6,
    Material=type)  # -> UtilY, UtilZ, Info
sort = SortList(Keys=bending_normal.UtilZ)  # -> reverse(Keys), ValuesA
sort_2 = SortList(Keys=bending_normal.UtilY)  # -> reverse(Keys), ValuesA
multiplication_9 = Multiplication(A=weave_2, B=weave)
item_12 = ListItem(List=sort_2.Keys, Index=0, Wrap=True)  # -> flatten(Item)
item_13 = ListItem(List=sort.Keys, Index=0, Wrap=True)  # -> flatten(Item)
multiplication_10 = Multiplication(A="403", B=multiplication_9)
max = Maximum(A=item_12, B=item_13)
division_6 = Division(A=multiplication_10, B="10000")
smaller = SmallerThan(FirstNumber=max, SecondNumber="1.0")  # -> SmallerThan, OrEqualTo
p_n_c_5 = PickNChoose(Pattern=smaller.SmallerThan, Stream0=addition_4, Stream1=repeat)
valid = ValidElements(Lines=disassemble_3.AxisOfElement, MinCrossSections=p_n_c_5, Stock=stock.Stock, mode="Steel")  # -> CrossSections, Weight
filter_9 = StreamFilter(Gate=larger_2.LargerThan, Stream0=valid.Weight, Stream1="0")
item_14 = ListItem(List=entwine_5, Index=valid.CrossSections, Wrap=True)
linetobeam_6 = LineToBeamKaramba3D(
    Line=disassemble_3.AxisOfElement,
    CrossSection=item_14,
    New=True,
    Remove=True,
    LimitDistance_m=0.005,
    Bending=True,
    SetBucklingLength=True,
    ToPolylineMaxAngle=0.03,
    ToPolylineTolerance=0.01,
    ToPolylineMinEdgeLength=0.25)  # -> Element, Points, Info
assemble_3 = AssembleModelKaramba3D(Elem=linetobeam_6.Element, LimitDistance_m=0.005)  # -> Model, Info, Mass_kg, CenterOfGravity, LoadCaseNames
modelview_3 = ModelViewKaramba3D(Model=assemble_3.Model, ResultFactors=1, ResultCase=-1)  # -> Model, DeformedMesh, DeformedAxes, DeformedModel
# Weld beam meshes has to be sedt to FALSE in the ini file of Karamba3d
# Check that karamba setting weld meshes is set to false?
beamview_3 = BeamViewKaramba3D(Model=modelview_3.Model)  # -> Model, MeshesOfRenderedBeams, DeformedBeamAxes, LegendColors, LegendTags
disassemble_5 = DisassembleModelKaramba3D(Model=assemble_3.Model)  # -> Model, Point, Beam, Shell, Support, Load, Line, Mesh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
disassemble_6 = DisassembleElementKaramba3D(Element=disassemble_5.Beam)  # -> Element, ElementIdentifier, AxisOfElement, CrossSection, Joint, Material, LocalCoordinateSystem, ElementIsActive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
disassemble_7 = DisassembleCrossSectionKaramba3D(CroSec=disassemble_6.CrossSection)  # -> CrossSection, FamilyNameOfCrossSection, TypeNameOfCrossSection, ElemIdentifiers, Color, Material, LocalEccentricity_cm, Heights_cm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
len_4 = Length(Curve=disassemble_6.AxisOfElement)
division_7 = Division(A=disassemble_7.Area_cm2, B="10000")
multiplication_11 = Multiplication(A=len_4, B=division_7)
faceb = FaceBoundaries(Mesh=beamview_3.MeshesOfRenderedBeams)
kgco2e_m_5 = Panel(division_6)
join = BrepJoin(Breps=faceb)  # -> Breps, Closed
smaller_2 = SmallerThan(FirstNumber=valid.CrossSections, SecondNumber="1")  # -> SmallerThan, OrEqualTo
join_2 = BrepJoin(Breps=join.Breps)  # -> flatten(Breps), Closed
lca_profile = SelectLCAProfile(
    SearchProfile="glulam",
    menu=[dropdown(None), dropdown(None), dropdown(None), dropdown(None), dropdown(None), dropdown(None), checkbox(off)])
lca_profile_2 = SelectLCAProfile(
    SearchProfile="S355",
    menu=[dropdown(None), dropdown(None), dropdown(None), dropdown(None), dropdown(None), dropdown(None), checkbox(off)])
weave_3 = Weave(Pattern=graft(smaller_2.SmallerThan), Stream0=lca_profile_2, Stream1=lca_profile, NullGaps=False)  # -> flatten(Weave)
material = DefineMaterial(LCAProfile=weave_3, Geometry=join_2.Breps, SetQuantity=multiplication_11, mode="SI", menu=[dropdown(None)])
construction = CreateConstruction(Material=material, menu=[dropdown(None)])
lca = RunLCA(Construction=construction, RunLCA=Toggle(True), Login=Button(), RunInCloud=Toggle(False))  # -> Construction, KgCO2e
num_2 = Number(lca.KgCO2e)
subtraction_8 = Subtraction(A="10000", B=num_2)
division_8 = Division(A=subtraction_8, B="10000")
panel_32 = Panel(lca.KgCO2e)
filter_10 = StreamFilter(Gate=bool, Stream0="0", Stream1=division_8)
filter_11 = StreamFilter(Gate=larger.LargerThan, Stream0=subtraction_6, Stream1=filter_10)
entwine_6 = Entwine(Branch00=loop_start_2.Data, Branch01=filter_11, Branch02=bool, FlattenInputs=True)
flip = FlipMatrix(Data=entwine_6)  # disabled
rec_2 = DataRecorder(flip, DataLimit=-10, RecordData=True)  # disabled
panel_33 = Panel(rec_2)  # disabled
replay_memory = DQNReplayMemory(
    Agent=loop_start_2.Data,
    State=tensor,
    Action=action,
    NewState=tensor_2,
    Reward=filter_11,
    Done=bool,
    Train=Toggle(True),
    Save=bool,
    Path=path_2,
    BatchSize="20",
    MinSize="20",
    MaxSize=10000,
    DiscountFactor=0.99,
    Epochs="2",
    UpdateTarget=25)
rec_3 = DataRecorder(replay_memory, DataLimit=-10, RecordData=True)  # disabled
panel_34 = Panel(rec_3)  # disabled
loop_end = LoopEnd(
    port=loop_start_2.port,
    Exit=bool,
    Data=replay_memory,
    Data_2=entwine_3,
    Data_3=filter,
    Data_4=filter_11,
    Data_5=entwine,
    TimeOutVal=0,
    pausedState=False,
    state="Output last")  # -> D0, D1, D2, D3, D4
loop_end_2 = LoopEnd(
    port=loop_start.port,
    Exit=False,
    Data=loop_end.D0,
    Data_2=loop_end.D3,
    TimeOutVal=0,
    pausedState=False,
    state="Last & Record")  # -> D0, flatten(D1)
graph_2 = QuickGraph(loop_end_2.D1, SortOrder=0)
cluster_10 = Cluster(G=pt, F=number_slider_4, pt=loop_end.D1)
results = VisualizeResults(
    Construction=lca.Construction,
    menu=[slider(0.16), buttons(off, off, off, on, off, off, off, off, off, off, off), dropdown(None), dropdown(None), slider(0), slider(100), buttons(off, on, off, off, off, off)])

# ==== cluster Cluster
F = ClusterInput()
pt = ClusterInput()
X = UnitX(Factor=F)
G = ClusterInput()
pt_2 = Point(pt)
move = Move(Geometry=G, Motion=X)  # -> Geometry, Transform
merge = Merge(Data1=pt_2, Data2=move.Geometry)  # -> flatten(Result)
panel = Panel("""-1
-2""")
cullpt = CullDuplicates(Points=merge, Tolerance=0.1, CullMode=3)  # -> Points, Indices, Valence
shift = ShiftList(List=cullpt.Points, Shift=1, Wrap=False)
shift_2 = ShiftList(List=cullpt.Points, Shift="2", Wrap=False)
item = ListItem(List=cullpt.Points, Index="-1", Wrap=True)  # -> Item1, Item
cull_i = CullIndex(List=cullpt.Points, Indices=panel, Wrap=True)
cull_i_2 = CullIndex(List=shift, Indices="-1", Wrap=True)
ln = Line(StartPoint=cull_i, EndPoint=cull_i_2)
ln_2 = Line(StartPoint=cull_i, EndPoint=shift_2)
ln_3 = Line(StartPoint=item.Item1, EndPoint=item.Item)
crv = Curve(flatten([ln_3, ln_2, ln]))
crv_2 = ClusterOutput(crv)

# ==== cluster Cluster_2
crv = ClusterInput()
matselect = MaterialSelectionKaramba3D(menu=[dropdown(1), dropdown(2)])
crv_2 = Curve(crv)
Z = UnitZ(Factor=Slider(40, range=0..100))
pos_ind = ClusterInput()
pos_ind_2 = ClusterInput()
rev = Reverse(Vector=Z)
pt = Point("3,0,3")
crosecrselect = CrossSectionRangeSelectorKaramba3D(MaximumHeight_cm=-1, MaximumWidth_cm=-1, Material=matselect, menu=[dropdown(1), dropdown(1), dropdown(1)])
supp = SupportKaramba3D(PosInd=pos_ind, menu=[buttons(on, on, on, on, off, on)])
supp_2 = SupportKaramba3D(PosInd=pos_ind_2, menu=[buttons(off, off, on, off, off, off)])
loads = LoadsKaramba3D(ForceVector=rev, Local=False, PosInd=pt, LCase="0", mode="Point")
midpt = CurveMiddle(Curve=crv_2)
pug_object = ClusterInput()
panel = Panel("""IPE200
IPE300""")
pug_object_2 = PugObject(pug_object)
pdecon = Deconstruct(Point=midpt)  # -> XComponent, YComponent, ZComponent
crosecselect = CrossSectionSelectorKaramba3D(CrossSections=crosecrselect, NameOrListIndexOfCrossSection=panel)  # -> flatten(CrossSection), Info
item = ListItem(List=crosecselect.CrossSection, Index=0, Wrap=True)
stock = CreateStock(Elements=pug_object_2, mode="Steel")  # -> Stock, CrossSections
beam_loads = BeamLoadsKaramba3D(BeamIdentifier="Loaded", LoadCase="0", ForceVector=rev, TStart=0, TEnd=1, mode="Block", menu=[buttons(off, on, off)])
equals = Equality(FirstNumber=pdecon.ZComponent, SecondNumber="0")  # -> Equality, Inequality
weave = Weave(Pattern=graft(equals.Equality), Stream0="Unloaded", Stream1="Loaded", NullGaps=False)  # -> flatten(Weave)
linetobeam = LineToBeamKaramba3D(
    Line=crv_2,
    Identifier=weave,
    CrossSection=item,
    New=True,
    Remove=True,
    LimitDistance_m=0.005,
    Bending=True,
    SetBucklingLength=True,
    ToPolylineMaxAngle=0.03,
    ToPolylineTolerance=0.01,
    ToPolylineMinEdgeLength=0.25)  # -> Element, Points, Info
assemble = AssembleModelKaramba3D(Elem=linetobeam.Element, Support=[supp, supp_2], Load=beam_loads, LimitDistance_m=0.005)  # -> Model, Info, Mass_kg, CenterOfGravity, LoadCaseNames
disassemble = DisassembleCrossSectionKaramba3D(CroSec=crosecselect.CrossSection)  # -> CrossSection, FamilyNameOfCrossSection, TypeNameOfCrossSection, ElemIdentifiers, Color, Material, LocalEccentricity_cm, Heights_cm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
opticrosec = OptimizeCrossSectionKaramba3D(
    Model=assemble.Model,
    CrossSections=crosecselect.CrossSection,
    MaximumUtilization=1,
    UltimateLimitStateIterations=5,
    DisplacementIterations=5,
    NumberOfSamplePoints=3,
    ElasticDesign=True,
    GammaM0=1,
    GammaM1=1.1,
    SwayFrame=True)  # -> ModelWithOptimizedCrossSections, Info, Mass_kg, MaximumDisplacement_cm, ElasticEnergyChange_kNm
len = TextLength(Text=opticrosec.Info)
larger = LargerThan(FirstNumber=len, SecondNumber="0")  # -> LargerThan, OrEqualTo
disassemble_2 = DisassembleModelKaramba3D(Model=opticrosec.ModelWithOptimizedCrossSections)  # -> Model, Point, Beam, Shell, Support, Load, Line, Mesh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
panel_2 = Panel(opticrosec.Info)
disassemble_3 = DisassembleElementKaramba3D(Element=disassemble_2.Beam)  # -> Element, ElementIdentifier, AxisOfElement, CrossSection, Joint, Material, LocalCoordinateSystem, ElementIsActive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
disassemble_4 = DisassembleCrossSectionKaramba3D(CroSec=disassemble_3.CrossSection)  # -> CrossSection, FamilyNameOfCrossSection, TypeNameOfCrossSection, ElemIdentifiers, Color, Material, LocalEccentricity_cm, Heights_cm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
mindex = MemberIndex(Set=stock.CrossSections, Member=disassemble_4.TypeNameOfCrossSection)  # -> flatten(Index), Count
valid = ValidElements(Lines=crv_2, MinCrossSections=mindex.Index, Stock=stock.Stock, mode="Steel")  # -> CrossSections, Weight
sort = SortList(Keys=valid.Weight)  # -> Keys, ValuesA
item_2 = ListItem(List=sort.Keys, Index=0, Wrap=True)
filter = StreamFilter(Gate=larger.LargerThan, Stream0=item_2, Stream1="0")
s_1 = ClusterOutput(filter)

# ==== cluster Cluster_3
graph = ClusterInput()
graph_2 = GraphMapper(graph, x0=0, x1=1, y0=0, y1=1, Ox=0.5023916364, Oy=1, Px=1, Py=0, container_name="Parabola")
graph_3 = ClusterOutput(graph_2)

# ==== cluster State
int = ClusterInput()
int_2 = Integer(int)
lng = ListLength(List=int_2)
subtraction = Subtraction(A="3", B=lng)
repeat = RepeatData(Data="0", Length=subtraction)
entwine = Entwine(Branch00=int_2, Branch01=repeat, FlattenInputs=True)  # -> flatten(Result)
R = ClusterOutput(entwine)

# ==== cluster Cluster_4
int = ClusterInput()
int_2 = ClusterInput()
int_3 = Integer(int)
int_4 = Integer(int_2)
lng = ListLength(List=int_4)
subtraction = Subtraction(A=int_3, B=lng)
repeat = RepeatData(Data="0", Length=subtraction)
entwine = Entwine(Branch00=int_4, Branch01=repeat, FlattenInputs=True)  # -> flatten(Result)
R = ClusterOutput(entwine)
