# Grasshopper definition SteelTrussAgent2D_Test_DQN.gh (Grasshopper 1.0.7)
# plug-ins: Karamba3D, Pug, Beaver, One Click LCA, Anemone, Owl.GH

number_slider = Slider(5, range=0..10)
number_slider_2 = Slider(1, range=0..1)
number_slider_3 = Slider(18, range=0..100)
division = Division(A=number_slider_3, B="13")
division_2 = Division(A=number_slider, B="7")
xz = XZPlane(Origin=Point(0, 0, 0))
kgco2e_m = Panel("266.4")
kgco2e_m_2 = Panel("6.0")
kgco2e_m_3 = Panel("96.4")
recgrid = Rectangular(Plane=xz, SizeX=division, SizeY=division_2, ExtentX="13", ExtentY="7")  # -> reverse(Cells), Points
number_slider_4 = Slider(28, range=0..100)
area = Area(Geometry=recgrid.Cells)  # -> Area, simplify(Centroid)
elem = DefineElement(CrossSsection="25x6", Material="GL24h", Length=Slider(14, range=0..100), Weight=kgco2e_m_2, mode="Steel")
elem_2 = DefineElement(CrossSsection="HEA260", Material="S355", Length=Slider(100, range=0..100), Weight=kgco2e_m, mode="Steel")
elem_3 = DefineElement(CrossSsection="HEA140", Material="S355", Length=Slider(15, range=0..100), Weight=kgco2e_m_3, mode="Steel")
pt = Point(area.Centroid)
flip = FlipMatrix(Data=pt)
division_3 = Division(A=number_slider_3, B=number_slider_4)
division_4 = Division(A=number_slider, B=number_slider_4)
subtraction = Subtraction(A="13", B="1")
intcrv = Interpolate(Vertices=flip, Degree=3, Periodic=False, KnotStyle=1)  # -> Curve, Length, Domain
intcrv_2 = Interpolate(Vertices=pt, Degree=3, Periodic=False, KnotStyle=1)  # -> Curve, Length, Domain
xz_2 = XZPlane(Origin=Point(0, 0, 0))
item = TreeItem(Tree=area.Centroid, Path=["0", subtraction], Index=0, Wrap=True)
pug_object = PugObject([elem, elem_3, elem_2])
recgrid_2 = Rectangular(Plane=xz_2, SizeX=division_3, SizeY=division_4, ExtentX=number_slider_4, ExtentY=number_slider_4)  # -> flatten(Cells), Points
test_actions = Panel("""0
0
0
0
0
0
0
0
0
0
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""")
int = Integer(test_actions)
item_2 = ListItem(List=int, Index=0, Wrap=True)
path = FilePath("C:\Users\diego\OneDrive\Dissertation\LaTeX\5\scripts\DQN__Model_77x50x50x50x2_final.hd5")
button = Button()
xlim_int = Integer(expr("x-2", "13"))
ylim_int = Integer("7")
number_slider_5 = Slider(25, range=0..100)
multiplication = Multiplication(A=xlim_int, B=ylim_int)
number_slider_6 = Slider(0, range=0..1000)
dqn = DQNAgent(
    Reset=button,
    Input=multiplication,
    Output="2",
    Hidden=[Slider(50, range=0..1000), Slider(50, range=0..1000), Slider(50, range=0..1000)],
    Path=path)
int_2 = Integer("0")
# initial state - half of it
panel = Panel("""0
-1""")
loop_start = LoopStart(N=number_slider_6, T=button, D0=dqn)  # -> port, Counter, Data, Data_2, Data_3
pt_2 = Point(area.Centroid)
lng = ListLength(List=pt_2)
cull_i = CullIndex(List=flatten(lng), Indices=panel, Wrap=True)  # -> graft(List)
button_2 = Button()
item_3 = ListItem(List=flatten(pt_2), Index=0, Wrap=True)
repeat = RepeatData(Data=int_2, Length=cull_i)
lng_2 = ListLength(List=flatten(repeat))
toggle = BooleanToggle(True)
multiplication_2 = Multiplication(A=number_slider_6, B=Slider(0.9, range=0..1))
# intermediate reward factor 1
# Ex = 7
# Ey = 5
# N = 100 Episodes
# ANN: [100]
panel_2 = Panel("Normal exploration policy")
panel_3 = Panel("default batch size")
# Ex = 8
# Ey = 6
# N = 100 Episodes
# ANN: [100]
panel_4 = Panel(loop_start.Counter)
int_3 = Integer("0")
pt_3 = Point(item_3)
int_4 = Integer("1")
int_5 = Integer("1")
loop_start_2 = LoopStart(
    N=Slider(100, range=0..1000),
    T=loop_start.Counter,
    x=int_5,
    y=int_4,
    pts=pt_3,
    state1=repeat,
    dqn=loop_start.Data,
    rew="0")  # -> port, Counter, Data, Data_2, Data_3, State1, Data_4, Data_5
remap = RemapNumbers(Value=loop_start.Counter, Source=multiplication_2, Target=Domain(0, 1))  # -> Mapped, Clipped
panel_5 = Panel("2")  # disabled
panel_6 = Panel("2")  # disabled
repeat_2 = RepeatData(Data=ylim_int, Length=panel_5)  # disabled
repeat_3 = RepeatData(Data=ylim_int, Length=panel_6)  # disabled
division_5 = Division(A="1100", B=16)
graph = GraphMapper(
    remap.Mapped,
    x0=0,
    x1=1,
    y0=0,
    y1=1,
    container_name="Bezier",
    cpx=[0, 0.1761380732, 0.3230769336, 1],
    cpy=[1, 0.6127009392, 0.1594203115, 0])
subtraction_2 = Subtraction(A=loop_start_2.Data, B="1")
lng_3 = ListLength(List=loop_start_2.Data_3)
int_6 = Integer("1")
matprops = MaterialPropertiesKaramba3D(
    FamilyOfMaterial="Steel",
    Name="Timber",
    YoungsModulus_kN_cm2="1100",
    InPlaneShearModulus_kN_cm2=division_5,
    TransverseShearModulus_kN_cm2=division_5,
    SpecificWeight_kN_m3="3.8",
    CoefficientOfThermalExpansion_1_C=1e-05,
    YieldStrength_kN_cm2="2.4",
    mode="Isotrop")
random = RandomNumber(Minimum="0", Maximum="1000", Seed=loop_start.Counter)
number_slider_7 = Slider(20, range=0..100)
mod = Modulus(A=lng_3, B="2")
license = LicenseKaramba3D()
viewer = ParamViewer(pt_2)
cluster = Cluster_2(int=loop_start_2.State1, I=int_6, A=subtraction_2, B=loop_start_2.Data_2)
flip_2 = FlipMatrix(Data=cluster)  # disabled
tensor = ConstructTensor(Values=flatten(flip_2))  # disabled
reshape = Reshape(Tensor=tensor, Shape=repeat_3)  # disabled
_2dpreview = Tensor2DPreview(Tensor=reshape, Range=Domain(0, 0), SaveAll=False)  # disabled
item_4 = ListItem(List=viewer, Index=loop_start_2.Data, Wrap=True)
remap_2 = RemapNumbers(Value=random, Source="1000", Target=Domain(0, 1))  # -> Mapped, Clipped
expression = Expression(rnd=remap_2.Mapped, threshold=graph, Expression="if(rnd<threshold,1,0)")
width_cm = Slider(6, range=4..14)
number_slider_8 = Slider(25, range=6..50)
Y = UnitY(Factor="0.01")
matselect = MaterialSelectionKaramba3D(menu=[dropdown(1), dropdown(2)])
width_cm_2 = Slider(6, range=4..14)
number_slider_9 = Slider(25, range=6..50)
panel_7 = Panel("25x6")
# intermediate reward factor 0.2
# Ex = 9
# Ey = 7
# N = 200 Episodes
# ANN: [100]
# Ex = 13
# Ey = 7
# N = 1000 Episodes
# ANN: [50,50,50]
panel_8 = Panel("Overwritten exploration policy")
panel_9 = Panel("batch size 200")
Z = UnitZ(Factor=Slider(200, range=0..1000))
neg = Negative(Value=Slider(20, range=0..100))
tensor_2 = ConstructTensor(Values=flatten(cluster), Shape=lng_2)
beam_joints = BeamJointsKaramba3D(
    AtElementIdentifiers="Remaining Elements",
    CtKNMAtStartingNode=Vector(0, 0, 0),
    CrKNmRadAtStartingNode=Y,
    CtKNMAtEndNode=Vector(0, 0, 0),
    CrKNmRadAtEndNode=Y,
    menu=[buttons(off, off, off, off, on, off), buttons(off, off, off, off, on, off)])
rev = Reverse(Vector=Z)
vec = VectorXYZ(XComponent=0, YComponent=0, ZComponent=neg)  # -> Vector, Length
branch = TreeBranch(Tree=pt_2, Path=item_4, MaintainPaths=True)
crosecrselect = CrossSectionRangeSelectorKaramba3D(MaximumHeight_cm=-1, MaximumWidth_cm=-1, Material=matselect, menu=[dropdown(1), dropdown(1), dropdown(3)])
cross_section = CrossSectionKaramba3D(
    FamilyNameOfCrossSection="DefaultCroSec",
    Material=matprops,
    Height_cm=number_slider_8,
    UpperFlangeWidth_cm=width_cm,
    LowerFlangeWidth_cm=width_cm,
    mode="Trapezoid")
crosecrselect_2 = CrossSectionRangeSelectorKaramba3D(MaximumHeight_cm=-1, MaximumWidth_cm=-1, Material=matselect, menu=[dropdown(1), dropdown(2), dropdown(3)])
item_5 = ListItem(List=loop_start_2.Data_3, Index="-1", Wrap=True)
beam_loads = BeamLoadsKaramba3D(
    BeamIdentifier="Upper Chord",
    LoadCase="0",
    ForceVector=vec.Vector,
    TStart=0,
    TEnd=1,
    mode="Block",
    menu=[buttons(off, on, off)])
panel_10 = Panel("Point list")
panel_11 = Panel("Next y")
panel_12 = Panel("Next x")
cross_section_2 = CrossSectionKaramba3D(
    FamilyNameOfCrossSection="DefaultCroSec",
    Material=matprops,
    Height_cm=number_slider_9,
    UpperFlangeWidth_cm=width_cm_2,
    LowerFlangeWidth_cm=width_cm_2,
    mode="Trapezoid")
item_6 = ListItem(List=branch, Index=loop_start_2.Data_2, Wrap=True)
random_2 = RandomNumber(Minimum="0", Maximum="1000", Seed=loop_start_2.Counter)
panel_13 = Panel("""HEA140
HEA260""")
panel_14 = Panel("""Upper Chord
Remaining Elements""")
item_7 = ListItem(List=crosecrselect_2, Index="10", Wrap=True)
remap_3 = RemapNumbers(Value=random_2, Source="1000", Target=Domain(0, 1))  # -> Mapped, Clipped
vec2pt = Vector2Pt(PointA=item_5, PointB=item_6, Unitize=Toggle(True))  # -> Vector, Length
toggle_2 = BooleanToggle(False)
panel_15 = Panel("Intermidiate Reward")
panel_16 = Panel("""Upper Chord
Remaining Elements""")
crosecselect = CrossSectionSelectorKaramba3D(CrossSections=crosecrselect, NameOrListIndexOfCrossSection=panel_13, ElementsIdentifiers="Loaded")  # -> flatten(CrossSection), Info
action = DQNChooseAction(DQNAgent=loop_start_2.Data_4, State=tensor_2, Ε="0")
devec = DeconstructVector(Vector=vec2pt.Vector)  # -> XComponent, YComponent, ZComponent
graph_2 = GraphMapper(
    remap_3.Mapped,
    x0=0,
    x1=1,
    y0=0,
    y1=1,
    container_name="Bezier",
    cpx=[0, 0.5, 0.8569890857, 1],
    cpy=[0, 0.1704545617, 0.5016479492, 1])
int_7 = Integer(expression)
int_8 = Integer("1")
pug_object_2 = PugObject(pug_object)
panel_17 = Panel("Overwrite epsilon")
panel_18 = Panel("Test actions")
addition = Addition(B="1")
panel_19 = Panel("Done?")
item_8 = ListItem(List=crosecselect.CrossSection, Index="1", Wrap=True)
item_9 = ListItem(List=item, Index=0, Wrap=True)  # -> Item1, Item
pdecon = Deconstruct(Point=item_9.Item1)  # -> XComponent, YComponent, ZComponent
avr = Average(Input=[item_9.Item1, item_9.Item])
supp = SupportKaramba3D(PosInd=item_9.Item, menu=[buttons(on, on, on, on, off, on)])
supp_2 = SupportKaramba3D(PosInd=item_9.Item1, menu=[buttons(off, off, on, on, off, on)])
loads = LoadsKaramba3D(ForceVector=rev, Local=False, PosInd=avr, LCase="0", mode="Point")
expression_2 = Expression(x=devec.XComponent, z=devec.ZComponent, f=Slider(0.2, range=0..1), Expression="f*(1-abs(z-x))")
stock = CreateStock(Elements=pug_object_2, mode="Steel")  # -> Stock, CrossSections
int_9 = Integer(graph_2)
filter = StreamFilter(Gate=int_7, Stream0=action, Stream1=int_9)
expression_3 = Expression(
    a=filter,
    x=loop_start_2.Data,
    y=loop_start_2.Data_2,
    n=mod,
    ylim=ylim_int,
    Expression="if((a=0) and (y<(ylim-1)) and (n=1),y+1,if(((a=0) and (n=0))or((a=1) and (n=1)),0,1))")
expression_4 = Expression(
    a=filter,
    x=loop_start_2.Data,
    y=loop_start_2.Data_2,
    n=mod,
    xlim=xlim_int,
    ylim=ylim_int,
    Expression="if((a=1) or ((x=xlim) and (y = (ylim-1))),1,0)")
expression_5 = Expression(
    a=filter,
    x=loop_start_2.Data,
    y=loop_start_2.Data_2,
    n=mod,
    ylim=ylim_int,
    Expression="if((a=1) or (y=(ylim-1)) or (n=0),x+1,x)")
filter_2 = StreamFilter(Gate=expression_4, Stream1=item_6)
expression_6 = Expression(
    x=loop_start_2.Data,
    y=loop_start_2.Data_2,
    n=mod,
    a=filter,
    xlim=xlim_int,
    ylim=ylim_int,
    Expression="if((x=xlim) and ((n=0) or (a=1)or (y=(ylim-1))),1,0)")
bool = Boolean(expression_4)
filter_3 = StreamFilter(Gate=bool, Stream0="0", Stream1=expression_2)
subtraction_3 = Subtraction(A=expression_5, B="1")
entwine = Entwine(Branch00=loop_start_2.Data_3, Branch01=filter_2, FlattenInputs=True)  # -> flatten(Result)
clean = CleanTree(RemoveNulls=True, RemoveInvalid=True, RemoveEmpty=False, Tree=entwine)
filter_4 = StreamFilter(Gate=bool, Stream0=loop_start_2.State1, Stream1=cluster)
entwine_2 = Entwine(Branch00=item_7, Branch01=crosecselect.CrossSection, FlattenInputs=True)  # -> flatten(Result)
cluster_2 = Cluster_2(int=filter_4, I=int_8, A=subtraction_3, B=expression_3)
panel_20 = Panel("Final bonus")
rec = DataRecorder(flatten(filter), DataLimit=-10, RecordData=True)
panel_21 = Panel(rec)
toggle_3 = BooleanToggle(False)
path_2 = FilePath("C:\Users\diego\OneDrive\Escritorio\")
# Final state as previous state so it does not return errors and it does not matter
filter_5 = StreamFilter(Gate=expression_6, Stream0=cluster_2, Stream1=cluster)
flip_3 = FlipMatrix(Data=filter_5)  # disabled
tensor_3 = ConstructTensor(Values=flatten(flip_3))  # disabled
reshape_2 = Reshape(Tensor=tensor_3, Shape=repeat_2)  # disabled
_2dpreview_2 = Tensor2DPreview(Tensor=reshape_2, Range=Domain(0, 0), SaveAll=False)  # disabled
number_slider_10 = Slider(12, range=0..100)
int_10 = Integer(filter_4)
number_slider_11 = Slider(100, range=0..100)
disassemble = DisassembleCrossSectionKaramba3D(CroSec=crosecselect.CrossSection)  # -> CrossSection, FamilyNameOfCrossSection, TypeNameOfCrossSection, ElemIdentifiers, Color, Material, LocalEccentricity_cm, Heights_cm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
tensor_4 = ConstructTensor(Values=flatten(filter_5), Shape=lng_2)
subtraction_4 = Subtraction(A=number_slider_10, B="1")
range = Range(Domain=number_slider_10, Steps=subtraction_4)
neg_2 = Negative(Value=Slider(20, range=0..100))
Z_2 = UnitZ(Factor=Slider(200, range=0..1000))
vec_2 = VectorXYZ(XComponent=0, YComponent=0, ZComponent=neg_2)  # -> Vector, Length
rev_2 = Reverse(Vector=Z_2)
supp_3 = SupportKaramba3D(PosInd=item_9.Item, menu=[buttons(on, on, on, on, off, on)])
supp_4 = SupportKaramba3D(PosInd=item_9.Item1, menu=[buttons(off, off, on, on, off, on)])
beam_loads_2 = BeamLoadsKaramba3D(
    BeamIdentifier="Upper Chord",
    LoadCase="0",
    ForceVector=vec_2.Vector,
    TStart=0,
    TEnd=1,
    mode="Block",
    menu=[buttons(off, on, off)])
loads_2 = LoadsKaramba3D(ForceVector=rev_2, Local=False, PosInd=avr, LCase="0", mode="Point")
entwine_3 = Entwine(Branch00=cross_section, Branch01=crosecselect.CrossSection, FlattenInputs=True)  # -> flatten(Result)
Y_2 = UnitY(Factor="0.01")
beam_joints_2 = BeamJointsKaramba3D(
    AtElementIdentifiers="Remaining Elements",
    CtKNMAtStartingNode=Vector(0, 0, 0),
    CrKNmRadAtStartingNode=Y_2,
    CtKNMAtEndNode=Vector(0, 0, 0),
    CrKNmRadAtEndNode=Y_2,
    menu=[buttons(off, off, off, off, on, off), buttons(off, off, off, off, on, off)])
panel_22 = Panel("factor*if((err=0) and (N<6),1-(co2/10000),neg)")
item_10 = ListItem(List=viewer, Index="-1", Wrap=True)
item_11 = ListItem(Index=0, Wrap=True)
item_12 = TreeItem(Tree=pt_2, Path=item_10, Index="0", Wrap=True)
entwine_4 = Entwine(Branch00=entwine, Branch01=item_12, FlattenInputs=True)  # -> flatten(Result)
gate = StreamGate(Stream=entwine_4, Gate=expression_6)  # -> Target0, Target1
sort_pt = SortPoints(Points=gate.Target1)  # -> Points, Indices
cluster_3 = Cluster(pt=sort_pt.Points)
crv = Curve(cluster_3)
lng_4 = ListLength(List=crv)
expression_7 = Expression(Done=expression_6, nbars=lng_4, nlim=number_slider_10, Expression="If((Done=1) and (nbars≤nlim),0,1)")
gate_2 = StreamGate(Stream=crv, Gate=expression_7)  # -> Target0, Target1
crv_2 = Curve(gate_2.Target0)
midpt = CurveMiddle(Curve=crv_2)
pdecon_2 = Deconstruct(Point=midpt)  # -> XComponent, YComponent, ZComponent
subtraction_5 = Subtraction(A=pdecon_2.ZComponent, B=pdecon.ZComponent)
abs = Absolute(Value=subtraction_5)
midpt_2 = CurveMiddle(Curve=crv_2)
smaller = SmallerThan(FirstNumber=abs, SecondNumber="0.001")  # -> SmallerThan, OrEqualTo
pdecon_3 = Deconstruct(Point=midpt_2)  # -> XComponent, YComponent, ZComponent
dispatch = Dispatch(List=crv_2, DispatchPattern=smaller.SmallerThan)  # -> ListA, ListB
equals = Equality(FirstNumber=pdecon_3.ZComponent, SecondNumber="0")  # -> Equality, Inequality
entwine_5 = Entwine(Branch00=dispatch.ListA, Branch01=dispatch.ListB, FlattenInputs=True)
dispatch_2 = Dispatch(List=crv_2, DispatchPattern=equals.Equality)  # -> ListA, ListB
linetobeam = LineToBeamKaramba3D(Line=dispatch_2.ListA, Identifier="Loaded", CrossSection=cross_section, New=True, Remove=True, LimitDistance_m=0.005)  # -> Element, Points, Info
crv_3 = Curve(entwine_5)
crv_4 = Curve(crv_3)
linetobeam_2 = LineToBeamKaramba3D(Line=dispatch_2.ListB, Identifier="Unloaded", CrossSection=cross_section_2, New=True, Remove=True, LimitDistance_m=0.005)  # -> Element, Points, Info
linetobeam_3 = LineToBeamKaramba3D(
    Line=crv_3,
    Identifier=graft(panel_16),
    CrossSection=item_8,
    New=True,
    Remove=True,
    LimitDistance_m=0.005,
    Bending=Toggle(True),
    SetBucklingLength=True,
    ToPolylineMaxAngle=0.03,
    ToPolylineTolerance=0.01,
    ToPolylineMinEdgeLength=0.25)  # -> flatten(Element), Points, Info
assemble = AssembleModelKaramba3D(Elem=flatten(linetobeam_3.Element), Support=[supp, supp_2], Load=beam_loads, Joint=beam_joints, LimitDistance_m=0.005)  # -> Model, Info, Mass_kg, CenterOfGravity, LoadCaseNames
dispatch_3 = Dispatch(List=crv_2, DispatchPattern=[True, False])  # -> ListA, ListB
analyze = AnalyzeKaramba3D(Model=assemble.Model)  # -> CalculatedModel, MaximumDisplacement_cm, ResultingForceOfGravity_kN, ElasticEnergyChange_kNm
opticrosec = OptimizeCrossSectionKaramba3D(
    Model=analyze.CalculatedModel,
    CrossSections=entwine_2,
    MaximumUtilization=1,
    UltimateLimitStateIterations=5,
    DisplacementIterations=5,
    NumberOfSamplePoints=3,
    ElasticDesign=True,
    GammaM0=1,
    GammaM1=1.1,
    SwayFrame=True)  # -> ModelWithOptimizedCrossSections, Info, Mass_kg, MaximumDisplacement_cm, ElasticEnergyChange_kNm
len = TextLength(Text=opticrosec.Info)
larger = LargerThan(FirstNumber=len, SecondNumber="0")  # -> LargerThan, OrEqualTo
len_2 = Length(Curve=crv)
utilization = UtilizationOfElementsKaramba3D(
    AnalyzedModel=opticrosec.ModelWithOptimizedCrossSections,
    NumberOfSamplePoints=3,
    ElasticDesign=True,
    GammaM0=1,
    GammaM1=1.1,
    SwayFrame=True,
    WithDetails=False,
    mode="Beams")  # -> AnalyzedModel, Utilization, SigMax_kN_cm2, SigMin_kN_cm2, TauMax_kN_cm2, UtilN, UtilVy, UtilVz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
larger_2 = LargerThan(FirstNumber=utilization.Utilization, SecondNumber="1")  # -> LargerThan, OrEqualTo
cull_i_2 = CullIndex(List=len_2, Indices=range, Wrap=True)
disassemble_2 = DisassembleModelKaramba3D(Model=opticrosec.ModelWithOptimizedCrossSections)  # -> Model, Point, Beam, Shell, Support, Load, Line, Mesh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
avr_2 = Average(Input=len_2)
lng_5 = ListLength(List=cull_i_2)
multiplication_3 = Multiplication(A=avr_2, B=lng_5)
panel_23 = Panel(opticrosec.Info)
modelview = ModelViewKaramba3D(Model=opticrosec.ModelWithOptimizedCrossSections, ResultFactors=1, ResultCase=-1)  # -> Model, DeformedMesh, DeformedAxes, DeformedModel; disabled
disassemble_3 = DisassembleElementKaramba3D(Element=disassemble_2.Beam)  # -> Element, ElementIdentifier, AxisOfElement, CrossSection, Joint, Material, LocalCoordinateSystem, ElementIsActive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
len_3 = Length(Curve=disassemble_3.AxisOfElement)
cull = CullPattern(List=len_3, CullPattern=larger_2.LargerThan)
lng_6 = ListLength(List=cull)
ma = MassAddition(Input=cull)  # -> Result, PartialResults
bool_2 = Boolean(lng_6)
multiplication_4 = Multiplication(A=bool_2, B=ma.Result)
lng_7 = ListLength(List=multiplication_4)
disassemble_4 = DisassembleCrossSectionKaramba3D(CroSec=disassemble_3.CrossSection)  # -> CrossSection, FamilyNameOfCrossSection, TypeNameOfCrossSection, ElemIdentifiers, Color, Material, LocalEccentricity_cm, Heights_cm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
mindex = MemberIndex(Set=panel_13, Member=disassemble_4.TypeNameOfCrossSection)  # -> flatten(Index), Count
addition_2 = Addition(A=mindex.Index, B="1")
lng_8 = ListLength(List=addition_2)
repeat_4 = RepeatData(Data="0", Length=lng_8)
# To avoid null errors
filter_6 = StreamFilter(Gate=lng_7, Stream0="0", Stream1=multiplication_4)
linetobeam_4 = LineToBeamKaramba3D(
    Line=crv_4,
    Identifier=graft(panel_14),
    CrossSection=cross_section,
    New=True,
    Remove=True,
    LimitDistance_m=0.005,
    Bending=True,
    SetBucklingLength=True,
    ToPolylineMaxAngle=0.03,
    ToPolylineTolerance=0.01,
    ToPolylineMinEdgeLength=0.25)  # -> flatten(Element), Points, Info
beamview = BeamViewKaramba3D(Model=modelview.Model)  # -> Model, MeshesOfRenderedBeams, DeformedBeamAxes, LegendColors, LegendTags; disabled
assemble_2 = AssembleModelKaramba3D(
    Elem=flatten(linetobeam_4.Element),
    Support=[supp_3, supp_4],
    Load=beam_loads_2,
    Joint=beam_joints_2,
    LimitDistance_m=0.005)  # -> Model, Info, Mass_kg, CenterOfGravity, LoadCaseNames
multiplication_5 = Multiplication(A="30680", B=disassemble_4.Area_cm2)
division_6 = Division(A=multiplication_5, B="10000")
analyze_2 = AnalyzeKaramba3D(Model=assemble_2.Model)  # -> CalculatedModel, MaximumDisplacement_cm, ResultingForceOfGravity_kN, ElasticEnergy_kNm
modelview_2 = ModelViewKaramba3D(Model=analyze_2.CalculatedModel, ResultFactors=1, ResultCase=-1)  # -> Model, DeformedMesh, DeformedAxes, DeformedModel
kgco2e_m_4 = Panel(division_6)
b_forces = BeamForcesKaramba3D(AnalyzedModel=modelview_2.Model, MaximumDistanceBetweenResults_m=-1, NumberOfResultsPerBeamElement=6)  # -> AnalyzedModel, simplify(NormalForce_kN), simplify(ShearForceVz_kN), simplify(ShearForceVy_kN), simplify(BendingMomentMt_kNm), simplify(BendingMomentMy_kNm), simplify(BendingMomentMz_kNm)
type = ValueList({"GL 24h", "GL 28h", "GL 32h", "GL 24c", "GL 28c", "GL 32c"}, selected="GL 24h")
beamview_2 = BeamViewKaramba3D(Model=modelview_2.Model)  # -> Model, MeshesOfRenderedBeams, DeformedBeamAxes, LegendColors, LegendTags; disabled
weave = Weave(Pattern=graft(equals.Equality), Stream0=width_cm_2, Stream1=width_cm, NullGaps=False)  # -> flatten(Weave)
weave_2 = Weave(Pattern=graft(equals.Equality), Stream0=number_slider_9, Stream1=number_slider_8, NullGaps=False)  # -> flatten(Weave)
bending_normal = BendingAndNormalForcesGeneral(
    Nd=b_forces.NormalForce_kN,
    Myd=b_forces.BendingMomentMy_kNm,
    Mzd=0,
    Base=graft(weave),
    Heigth=graft(weave_2),
    BucklingLengthY=0,
    BucklingLengthZ=0,
    EffectiveLengthAsARatioOfTheSpan=1,
    ModificationFactor=0.6,
    Material=type)  # -> UtilY, UtilZ, Info
sort = SortList(Keys=bending_normal.UtilZ)  # -> reverse(Keys), ValuesA
sort_2 = SortList(Keys=bending_normal.UtilY)  # -> reverse(Keys), ValuesA
multiplication_6 = Multiplication(A=weave_2, B=weave)
item_13 = ListItem(List=sort_2.Keys, Index=0, Wrap=True)  # -> flatten(Item)
item_14 = ListItem(List=sort.Keys, Index=0, Wrap=True)  # -> flatten(Item)
multiplication_7 = Multiplication(A="403", B=multiplication_6)
max = Maximum(A=item_13, B=item_14)
division_7 = Division(A=multiplication_7, B="10000")
smaller_2 = SmallerThan(FirstNumber=max, SecondNumber="1.0")  # -> SmallerThan, OrEqualTo
p_n_c = PickNChoose(Pattern=smaller_2.SmallerThan, Stream0=addition_2, Stream1=repeat_4)
valid = ValidElements(Lines=disassemble_3.AxisOfElement, MinCrossSections=p_n_c, Stock=stock.Stock, mode="Steel")  # -> CrossSections, Weight
filter_7 = StreamFilter(Gate=larger.LargerThan, Stream0=valid.Weight, Stream1="0")
item_15 = ListItem(List=entwine_3, Index=valid.CrossSections, Wrap=True)
linetobeam_5 = LineToBeamKaramba3D(
    Line=disassemble_3.AxisOfElement,
    CrossSection=item_15,
    New=True,
    Remove=True,
    LimitDistance_m=0.005,
    Bending=True,
    SetBucklingLength=True,
    ToPolylineMaxAngle=0.03,
    ToPolylineTolerance=0.01,
    ToPolylineMinEdgeLength=0.25)  # -> Element, Points, Info
assemble_3 = AssembleModelKaramba3D(Elem=linetobeam_5.Element, LimitDistance_m=0.005)  # -> Model, Info, Mass_kg, CenterOfGravity, LoadCaseNames
modelview_3 = ModelViewKaramba3D(Model=assemble_3.Model, ResultFactors=1, ResultCase=-1)  # -> Model, DeformedMesh, DeformedAxes, DeformedModel
# Weld beam meshes has to be sedt to FALSE in the ini file of Karamba3d
# Check that karamba setting weld meshes is set to false?
beamview_3 = BeamViewKaramba3D(Model=modelview_3.Model)  # -> Model, MeshesOfRenderedBeams, DeformedBeamAxes, LegendColors, LegendTags
disassemble_5 = DisassembleModelKaramba3D(Model=assemble_3.Model)  # -> Model, Point, Beam, Shell, Support, Load, Line, Mesh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
disassemble_6 = DisassembleElementKaramba3D(Element=disassemble_5.Beam)  # -> Element, ElementIdentifier, AxisOfElement, CrossSection, Joint, Material, LocalCoordinateSystem, ElementIsActive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
faceb = FaceBoundaries(Mesh=beamview_3.MeshesOfRenderedBeams)
disassemble_7 = DisassembleCrossSectionKaramba3D(CroSec=disassemble_6.CrossSection)  # -> CrossSection, FamilyNameOfCrossSection, TypeNameOfCrossSection, ElemIdentifiers, Color, Material, LocalEccentricity_cm, Heights_cm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
srf = Surface(faceb)
join = BrepJoin(Breps=srf)  # -> Breps, Closed
len_4 = Length(Curve=disassemble_6.AxisOfElement)
division_8 = Division(A=disassemble_7.Area_cm2, B="10000")
join_2 = BrepJoin(Breps=join.Breps)  # -> Breps, Closed
item_16 = ListItem(List=join_2.Breps, Index=0, Wrap=True)  # -> flatten(Item)
multiplication_8 = Multiplication(A=len_4, B=division_8)
kgco2e_m_5 = Panel(division_7)
smaller_3 = SmallerThan(FirstNumber=valid.CrossSections, SecondNumber="1")  # -> SmallerThan, OrEqualTo
lca_profile = SelectLCAProfile(
    SearchProfile="glulam",
    menu=[dropdown(None), dropdown(None), dropdown(None), dropdown(None), dropdown(None), dropdown(None), checkbox(off)])
lca_profile_2 = SelectLCAProfile(
    SearchProfile="S355",
    menu=[dropdown(None), dropdown(None), dropdown(None), dropdown(None), dropdown(None), dropdown(None), checkbox(off)])
weave_3 = Weave(Pattern=graft(smaller_3.SmallerThan), Stream0=lca_profile_2, Stream1=lca_profile, NullGaps=False)  # -> flatten(Weave)
material = DefineMaterial(LCAProfile=weave_3, Geometry=item_16, SetQuantity=multiplication_8, mode="SI", menu=[dropdown(None)])
lng_9 = ListLength(List=material)  # -> expr("x-1", Length)
range_2 = Range(Domain=lng_9, Steps=lng_9)
construction = CreateConstruction(Material=graft(material), Comment=graft(range_2), menu=[dropdown(None)])  # -> flatten(Construction)
lca = RunLCA(Construction=construction, RunLCA=Toggle(True), Login=Button(), RunInCloud=Toggle(False))  # -> Construction, KgCO2e
panel_24 = Panel(lca.KgCO2e)
num = Number(flatten(lca.KgCO2e))
expression_8 = Expression(
    co2=num,
    lUtilErr=filter_6,
    lNerr=multiplication_3,
    err=expression_7,
    neg="-0.02",
    factor=Slider(10, range=0..10),
    Expression="factor*if(err=1,neg*lNerr,(1-(co2/10000)+neg*lUtilErr))")
filter_8 = StreamFilter(Gate=expression_6, Stream0=filter_3, Stream1=expression_8)
replay_memory = DQNReplayMemory(
    Agent=loop_start_2.Data_4,
    State=tensor_2,
    Action=filter,
    NewState=tensor_4,
    Reward=filter_8,
    Done=expression_6,
    Train=toggle_3,
    Save=toggle_3,
    BatchSize=Slider(200, range=0..1000),
    MinSize=Slider(5, range=0..10),
    MaxSize=10000,
    DiscountFactor=0.99,
    Epochs=1,
    UpdateTarget=25)
addition_3 = Addition(A=loop_start_2.Data_5, B=filter_8)
loop_end = LoopEnd(
    port=loop_start_2.port,
    Exit=expression_6,
    Data=expression_5,
    Data_2=expression_3,
    Data_3=clean,
    State1=int_10,
    Data_4=replay_memory,
    Data_5=addition_3,
    TimeOutVal=0,
    pausedState=False,
    state="Output last")  # -> x, y, pts, state1, dqn, rew
merge = Merge(Data1=loop_start.Data_2, Data2=loop_end.rew)  # -> flatten(Result)
entwine_6 = Entwine(Branch00=loop_end.pts, Branch01=item_12, FlattenInputs=True)  # -> flatten(Result)
ma_2 = MassAddition(Input=loop_end.state1)  # -> Result, PartialResults
loop_end_2 = LoopEnd(
    port=loop_start.port,
    Exit=False,
    Data=loop_end.dqn,
    Data_2=merge,
    Data_3=ma_2.Result,
    TimeOutVal=0,
    pausedState=False,
    state="Output last")  # -> D0, D1, D2
bnd = Bounds(Numbers=loop_end_2.D1)
item_17 = ListItem(List=loop_end_2.D1, Index="-1", Wrap=True)
panel_25 = Panel(bnd)
graph_3 = QuickGraph(loop_end_2.D1, SortOrder=0)
panel_26 = Panel(item_17)
sort_pt_2 = SortPoints(Points=entwine_6)  # -> Points, Indices
panel_27 = Panel(loop_end_2.D2)
panel_28 = Panel(loop_end_2.D1)
cluster_4 = Cluster(pt=sort_pt_2.Points)
results = VisualizeResults(
    Construction=lca.Construction,
    menu=[slider(0.23), buttons(off, off, off, on, off, off, off, off, off, off, off), dropdown(None), dropdown(None), slider(0), slider(100), buttons(off, on, off, off, off, off)])

# ==== cluster Cluster
pt = ClusterInput()
pt_2 = Point(pt)
panel = Panel("""-1
-2""")
shift = ShiftList(List=pt_2, Shift=1, Wrap=False)
shift_2 = ShiftList(List=pt_2, Shift="2", Wrap=False)
item = ListItem(List=pt_2, Index="-1", Wrap=True)  # -> Item1, Item
cull_i = CullIndex(List=pt_2, Indices=panel, Wrap=True)
cull_i_2 = CullIndex(List=shift, Indices="-1", Wrap=True)
ln = Line(StartPoint=cull_i, EndPoint=cull_i_2)
ln_2 = Line(StartPoint=cull_i, EndPoint=shift_2)
ln_3 = Line(StartPoint=item.Item1, EndPoint=item.Item)
crv = Curve(flatten([ln_3, ln_2, ln]))
crv_2 = ClusterOutput(crv)

# ==== cluster Cluster_2
int = ClusterInput()
I = ClusterInput()
int_2 = Integer(int)
A = ClusterInput()
B = ClusterInput()
lng = ListLength(List=int_2)  # -> flatten(Length)
item = ListItem(List=lng, Index=0, Wrap=True)
multiplication = Multiplication(A=A, B=item)
addition = Addition(A=multiplication, B=B)
replace = ReplaceItems(List=flatten(int_2), Item=I, Indices=addition, Wrap=False)
unflatten = UnflattenTree(Tree=replace, Guide=int_2)
T = ClusterOutput(unflatten)
