# Grasshopper definition SteelTrussAgent_Train_Galapagos.gh (Grasshopper 1.0.7)
# plug-ins: Karamba3D, Pug, Beaver, One Click LCA

panel = Panel("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")
path = FilePath("C:\Users\diego\OneDrive\Dissertation\LaTeX\5\scripts\boards_9x13_L18_H7.txt")
file = ReadFile(File=path, PerLineParse=True)
txt = Text(file)
split = TextSplit(Text=txt, Separators=";")
cull_i = CullIndex(List=split, Indices="-1", Wrap=True)
number_slider = Slider(1, range=0..1)

# ---- group: Animate
number_slider_2 = Slider(73, range=0..1749)

# ----
number_slider_3 = Slider(5, range=0..10)
partition = PartitionList(List=cull_i, Size="9")
number_slider_4 = Slider(18, range=0..100)
viewer = ParamViewer(partition)
division = Division(A=number_slider_4, B="13")
division_2 = Division(A=number_slider_3, B="7")
xz = XZPlane(Origin=Point(0, 0, 0))
kgco2e_m = Panel("266.4")
kgco2e_m_2 = Panel("6.0")
kgco2e_m_3 = Panel("96.4")
item = ListItem(List=viewer, Index=number_slider_2, Wrap=True)
recgrid = Rectangular(Plane=xz, SizeX=division, SizeY=division_2, ExtentX="13", ExtentY="7")  # -> reverse(Cells), Points
branch = TreeBranch(Tree=partition, Path=item, MaintainPaths=True)
number_slider_5 = Slider(28, range=0..100)
area = Area(Geometry=recgrid.Cells)  # -> Area, simplify(Centroid)
panel_2 = Panel("""-1
-1
-1
5
-1
0
-1
-1
-1
3
-1""")
elem = DefineElement(CrossSsection="25x6", Material="GL24h", Length=Slider(14, range=0..100), Weight=kgco2e_m_2, mode="Steel")
elem_2 = DefineElement(CrossSsection="HEA260", Material="S355", Length=Slider(100, range=0..100), Weight=kgco2e_m, mode="Steel")
elem_3 = DefineElement(CrossSsection="HEA140", Material="S355", Length=Slider(15, range=0..100), Weight=kgco2e_m_3, mode="Steel")
split_2 = TextSplit(Text=branch, Separators=",")
pt = Point(area.Centroid)
flip = FlipMatrix(Data=area.Centroid)  # -> flatten(Data)
subtraction = Subtraction(A="13", B="1")
flip_2 = FlipMatrix(Data=pt)
trim = TrimTree(Tree=split_2, Depth=1)
number_slider_6 = Slider(8, range=0..10)
division_3 = Division(A=number_slider_4, B=number_slider_5)
division_4 = Division(A=number_slider_3, B=number_slider_5)
intcrv = Interpolate(Vertices=pt, Degree=3, Periodic=False, KnotStyle=1)  # -> Curve, Length, Domain
intcrv_2 = Interpolate(Vertices=flip_2, Degree=3, Periodic=False, KnotStyle=1)  # -> Curve, Length, Domain
subtraction_2 = Subtraction(A="13", B="1")
item_2 = TreeItem(Tree=simplify(area.Centroid), Path=["0", subtraction], Index=0, Wrap=True)
cull = CullPattern(List=flip, CullPattern=trim)

# ---- group: DQN or Galapagos
toggle = BooleanToggle(True)

# ----
xz_2 = XZPlane(Origin=Point(0, 0, 0))
item_3 = TreeItem(Tree=area.Centroid, Path=["0", subtraction_2], Index=0, Wrap=True)
pug_object = PugObject([elem, elem_3, elem_2])
range = Range(Domain=number_slider_6, Steps=number_slider_6)
int = Integer(panel_2)
recgrid_2 = Rectangular(Plane=xz_2, SizeX=division_3, SizeY=division_4, ExtentX=number_slider_5, ExtentY=number_slider_5)  # -> flatten(Cells), Points
genes = GenePool(Decimals=0, Maximum=6, Minimum=-1, Value=[-1, 0, -1, 2, -1, -1, 3, 0, 3, -1])
num = Number(panel_2)
mindex = MemberIndex(Set=range, Member=graft(num))  # -> Index, Count
panel_3 = Panel(genes)
split_3 = SplitList(List=genes, Index="5")  # -> ListA, ListB
entwine = Entwine(Branch00="0", Branch01=split_3.ListA, Branch02="0", Branch03=split_3.ListB, Branch04="0", FlattenInputs=True)  # -> simplify(graft(Result))
item_4 = ListItem(List=area.Centroid, Index=entwine, Wrap=Toggle(False))  # -> flatten(Item)
clean = CleanTree(RemoveNulls=True, RemoveInvalid=True, RemoveEmpty=False, Tree=item_4)
filter = StreamFilter(Gate=toggle, Stream0=cull, Stream1=clean)
sort_pt = SortPoints(Points=filter)  # -> Points, Indices
cluster = Cluster(pt=sort_pt.Points)
crv = Curve(cluster)
galapagos = Galapagos(fitness=num_3, gene=genes)
panel_4 = Panel(clean)
# Penalization in case of null result from Karamba
smaller = SmallerThan(SecondNumber="100")  # -> SmallerThan, OrEqualTo
curvepoint = PointOnCurve(crv, parameter=0.5)
division_5 = Division(A="1100", B=16)
matprops = MaterialPropertiesKaramba3D(
    FamilyOfMaterial="Steel",
    Name="Timber",
    YoungsModulus_kN_cm2="1100",
    InPlaneShearModulus_kN_cm2=division_5,
    TransverseShearModulus_kN_cm2=division_5,
    SpecificWeight_kN_m3="3.8",
    CoefficientOfThermalExpansion_1_C=1e-05,
    YieldStrength_kN_cm2="2.4",
    mode="Isotrop")
panel_5 = Panel("C:\Users\diego\OneDrive\Dissertation\LaTeX\5\scripts\rewards_trusses_2.txt")  # disabled
number_slider_7 = Slider(20, range=0..100)
pdecon = Deconstruct(Point=curvepoint)  # -> XComponent, YComponent, ZComponent
license = LicenseKaramba3D()
matselect = MaterialSelectionKaramba3D(menu=[dropdown(1), dropdown(2)])
lng = ListLength(List=crv)
midpt = CurveMiddle(Curve=crv)
panel_6 = Panel("25x6")
Z = UnitZ(Factor=Slider(200, range=0..1000))
neg = Negative(Value=Slider(20, range=0..100))
rev = Reverse(Vector=Z)
vec = VectorXYZ(XComponent=0, YComponent=0, ZComponent=neg)  # -> Vector, Length
crosecrselect = CrossSectionRangeSelectorKaramba3D(MaximumHeight_cm=-1, MaximumWidth_cm=-1, Material=matselect, menu=[dropdown(1), dropdown(1), dropdown(3)])
pdecon_2 = Deconstruct(Point=midpt)  # -> XComponent, YComponent, ZComponent
crosecrselect_2 = CrossSectionRangeSelectorKaramba3D(MaximumHeight_cm=-1, MaximumWidth_cm=-1, Material=matselect, menu=[dropdown(1), dropdown(2), dropdown(3)])
beam_loads = BeamLoadsKaramba3D(
    BeamIdentifier="Upper Chord",
    LoadCase="0",
    ForceVector=vec.Vector,
    TStart=0,
    TEnd=1,
    mode="Block",
    menu=[buttons(off, on, off)])
equals = Equality(FirstNumber=pdecon_2.ZComponent, SecondNumber="0")  # -> Equality, Inequality
panel_7 = Panel("""HEA140
HEA260""")
item_5 = ListItem(List=crosecrselect_2, Index="10", Wrap=True)
toggle_2 = BooleanToggle(False)
crosecselect = CrossSectionSelectorKaramba3D(CrossSections=crosecrselect, NameOrListIndexOfCrossSection=panel_7, ElementsIdentifiers="Loaded")  # -> flatten(CrossSection), Info
panel_8 = Panel("""Upper Chord
Remaining Elements""")
dispatch = Dispatch(List=crv, DispatchPattern=equals.Equality)  # -> ListA, ListB

width_cm = Slider(6, range=4..14)
number_slider_8 = Slider(25, range=6..50)
cross_section = CrossSectionKaramba3D(
    FamilyNameOfCrossSection="DefaultCroSec",
    Material=matprops,
    Height_cm=number_slider_8,
    UpperFlangeWidth_cm=width_cm,
    LowerFlangeWidth_cm=width_cm,
    mode="Trapezoid")
linetobeam = LineToBeamKaramba3D(Line=dispatch.ListA, Identifier="Loaded", CrossSection=cross_section, New=True, Remove=True, LimitDistance_m=0.005)  # -> Element, Points, Info

width_cm_2 = Slider(6, range=4..14)
number_slider_9 = Slider(25, range=6..50)
cross_section_2 = CrossSectionKaramba3D(
    FamilyNameOfCrossSection="DefaultCroSec",
    Material=matprops,
    Height_cm=number_slider_9,
    UpperFlangeWidth_cm=width_cm_2,
    LowerFlangeWidth_cm=width_cm_2,
    mode="Trapezoid")
linetobeam_2 = LineToBeamKaramba3D(Line=dispatch.ListB, Identifier="Unloaded", CrossSection=cross_section_2, New=True, Remove=True, LimitDistance_m=0.005)  # -> Element, Points, Info

pug_object_2 = PugObject(pug_object)
number_slider_10 = Slider(12, range=0..100)
expression = Expression(nbars=lng, nlim=number_slider_10, Expression="If(nbars≤nlim,0,1)")
item_6 = ListItem(List=crosecselect.CrossSection, Index="1", Wrap=True)
item_7 = ListItem(List=item_2, Index=0, Wrap=True)  # -> Item1, Item
pdecon_3 = Deconstruct(Point=item_7.Item1)  # -> XComponent, YComponent, ZComponent
subtraction_3 = Subtraction(A=pdecon.ZComponent, B=pdecon_3.ZComponent)
abs = Absolute(Value=subtraction_3)
avr = Average(Input=[item_7.Item1, item_7.Item])
smaller_2 = SmallerThan(FirstNumber=abs, SecondNumber="0.001")  # -> SmallerThan, OrEqualTo
supp = SupportKaramba3D(PosInd=item_7.Item, menu=[buttons(on, on, on, on, off, on)])
supp_2 = SupportKaramba3D(PosInd=item_7.Item1, menu=[buttons(off, off, on, on, off, on)])
dispatch_2 = Dispatch(List=crv, DispatchPattern=smaller_2.SmallerThan)  # -> ListA, ListB
entwine_2 = Entwine(Branch00=dispatch_2.ListA, Branch01=dispatch_2.ListB, FlattenInputs=True)
linetobeam_3 = LineToBeamKaramba3D(
    Line=entwine_2,
    Identifier=graft(panel_8),
    CrossSection=item_6,
    New=True,
    Remove=True,
    LimitDistance_m=0.005,
    Bending=Toggle(True),
    SetBucklingLength=True,
    ToPolylineMaxAngle=0.03,
    ToPolylineTolerance=0.01,
    ToPolylineMinEdgeLength=0.25)  # -> flatten(Element), Points, Info
stock = CreateStock(Elements=pug_object_2, mode="Steel")  # -> Stock, CrossSections
entwine_3 = Entwine(Branch00=item_5, Branch01=crosecselect.CrossSection, FlattenInputs=True)  # -> flatten(Result)
subtraction_4 = Subtraction(A=number_slider_10, B="1")
len = Length(Curve=crv)
range_2 = Range(Domain=subtraction_4, Steps=subtraction_4)
assemble = AssembleModelKaramba3D(Elem=flatten(linetobeam_3.Element), Support=[supp, supp_2], Load=beam_loads, LimitDistance_m=0.005)  # -> Model, Info, Mass_kg, CenterOfGravity, LoadCaseNames
number_slider_11 = Slider(100, range=0..100)
cull_i_2 = CullIndex(List=len, Indices=range_2, Wrap=True)
dispatch_3 = Dispatch(List=crv, DispatchPattern=[True, False])  # -> ListA, ListB
panel_9 = Panel("Unloaded")
avr_2 = Average(Input=len)
lng_2 = ListLength(List=cull_i_2)
disassemble = DisassembleCrossSectionKaramba3D(CroSec=crosecselect.CrossSection)  # -> CrossSection, FamilyNameOfCrossSection, TypeNameOfCrossSection, ElemIdentifiers, Color, Material, LocalEccentricity_cm, Heights_cm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
analyze = AnalyzeKaramba3D(Model=assemble.Model)  # -> CalculatedModel, MaximumDisplacement_cm, ResultingForceOfGravity_kN, ElasticEnergyChange_kNm
opticrosec = OptimizeCrossSectionKaramba3D(
    Model=analyze.CalculatedModel,
    CrossSections=entwine_3,
    MaximumUtilization=1,
    UltimateLimitStateIterations=5,
    DisplacementIterations=5,
    NumberOfSamplePoints=3,
    ElasticDesign=True,
    GammaM0=1,
    GammaM1=1.1,
    SwayFrame=True)  # -> ModelWithOptimizedCrossSections, Info, Mass_kg, MaximumDisplacement_cm, ElasticEnergyChange_kNm
len_2 = TextLength(Text=opticrosec.Info)
larger = LargerThan(FirstNumber=len_2, SecondNumber="0")  # -> LargerThan, OrEqualTo
or = GateOr(A=smaller.SmallerThan, B=larger.LargerThan)
filter_2 = StreamFilter(Gate=or, Stream0="0", Stream1="20000")
addition = Addition(B=filter_2)
fitness_num = Number(addition)
rec = DataRecorder(fitness_num, DataLimit=-10, RecordData=True)
lng_3 = ListLength(List=rec)
panel_10 = Panel(lng_3)
len_3 = TextLength(Text=opticrosec.Info)
multiplication = Multiplication(A=avr_2, B=lng_2)
larger_2 = LargerThan(FirstNumber=len_3, SecondNumber="0")  # -> LargerThan, OrEqualTo
Z_2 = UnitZ(Factor=Slider(200, range=0..1000))
utilization = UtilizationOfElementsKaramba3D(
    AnalyzedModel=opticrosec.ModelWithOptimizedCrossSections,
    NumberOfSamplePoints=3,
    ElasticDesign=True,
    GammaM0=1,
    GammaM1=1.1,
    SwayFrame=True,
    WithDetails=False,
    mode="Beams")  # -> AnalyzedModel, Utilization, SigMax_kN_cm2, SigMin_kN_cm2, TauMax_kN_cm2, UtilN, UtilVy, UtilVz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
larger_3 = LargerThan(FirstNumber=utilization.Utilization, SecondNumber="1")  # -> LargerThan, OrEqualTo
rev_2 = Reverse(Vector=Z_2)
disassemble_2 = DisassembleModelKaramba3D(Model=opticrosec.ModelWithOptimizedCrossSections)  # -> Model, Point, Beam, Shell, Support, Load, Line, Mesh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
supp_3 = SupportKaramba3D(PosInd=item_7.Item, menu=[buttons(on, on, on, on, off, on)])
supp_4 = SupportKaramba3D(PosInd=item_7.Item1, menu=[buttons(off, off, on, on, off, on)])
loads = LoadsKaramba3D(ForceVector=rev_2, Local=False, PosInd=avr, LCase="0", mode="Point")
entwine_4 = Entwine(Branch00=cross_section, Branch01=crosecselect.CrossSection, FlattenInputs=True)  # -> flatten(Result)
panel_11 = Panel(opticrosec.Info)
modelview = ModelViewKaramba3D(Model=opticrosec.ModelWithOptimizedCrossSections, ResultFactors=1, ResultCase=-1)  # -> Model, DeformedMesh, DeformedAxes, DeformedModel
disassemble_3 = DisassembleElementKaramba3D(Element=disassemble_2.Beam)  # -> Element, ElementIdentifier, AxisOfElement, CrossSection, Joint, Material, LocalCoordinateSystem, ElementIsActive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
len_4 = Length(Curve=disassemble_3.AxisOfElement)
cull_2 = CullPattern(List=len_4, CullPattern=larger_3.LargerThan)
lng_4 = ListLength(List=cull_2)
ma = MassAddition(Input=cull_2)  # -> Result, PartialResults
bool = Boolean(lng_4)
multiplication_2 = Multiplication(A=bool, B=ma.Result)
lng_5 = ListLength(List=multiplication_2)
# To avoid null errors
filter_3 = StreamFilter(Gate=lng_5, Stream0="0", Stream1=multiplication_2)
beamview = BeamViewKaramba3D(Model=assemble.Model)  # -> Model, MeshesOfRenderedBeams, DeformedBeamAxes, LegendColors, LegendTags
disassemble_4 = DisassembleCrossSectionKaramba3D(CroSec=disassemble_3.CrossSection)  # -> CrossSection, FamilyNameOfCrossSection, TypeNameOfCrossSection, ElemIdentifiers, Color, Material, LocalEccentricity_cm, Heights_cm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
mindex_2 = MemberIndex(Set=panel_7, Member=disassemble_4.TypeNameOfCrossSection)  # -> flatten(Index), Count
addition_2 = Addition(A=mindex_2.Index, B="1")
lng_6 = ListLength(List=addition_2)
repeat = RepeatData(Data="0", Length=lng_6)
linetobeam_4 = LineToBeamKaramba3D(
    Line=entwine_2,
    CrossSection=item_6,
    New=True,
    Remove=True,
    LimitDistance_m=0.005,
    Bending=True,
    SetBucklingLength=True,
    ToPolylineMaxAngle=0.03,
    ToPolylineTolerance=0.01,
    ToPolylineMinEdgeLength=0.25)  # -> Element, Points, Info
assemble_2 = AssembleModelKaramba3D(Elem=flatten([linetobeam.Element, linetobeam_2.Element]), Support=[supp_3, supp_4], Load=loads, LimitDistance_m=0.005)  # -> Model, Info, Mass_kg, CenterOfGravity, LoadCaseNames
multiplication_3 = Multiplication(A="30680", B=disassemble_4.Area_cm2)
division_6 = Division(A=multiplication_3, B="10000")
analyze_2 = AnalyzeKaramba3D(Model=assemble_2.Model)  # -> CalculatedModel, MaximumDisplacement_cm, ResultingForceOfGravity_kN, ElasticEnergy_kNm
modelview_2 = ModelViewKaramba3D(Model=analyze_2.CalculatedModel, ResultFactors=1, ResultCase=-1)  # -> Model, DeformedMesh, DeformedAxes, DeformedModel
kgco2e_m_4 = Panel(division_6)
b_forces = BeamForcesKaramba3D(AnalyzedModel=modelview_2.Model, MaximumDistanceBetweenResults_m=-1, NumberOfResultsPerBeamElement=6)  # -> AnalyzedModel, simplify(NormalForce_kN), simplify(ShearForceVz_kN), simplify(ShearForceVy_kN), simplify(BendingMomentMt_kNm), simplify(BendingMomentMy_kNm), simplify(BendingMomentMz_kNm)
type = ValueList({"GL 24h", "GL 28h", "GL 32h", "GL 24c", "GL 28c", "GL 32c"}, selected="GL 24h")
beamview_2 = BeamViewKaramba3D(Model=modelview_2.Model)  # -> Model, MeshesOfRenderedBeams, DeformedBeamAxes, LegendColors, LegendTags
weave = Weave(Pattern=graft(equals.Equality), Stream0=width_cm_2, Stream1=width_cm, NullGaps=False)  # -> flatten(Weave)
weave_2 = Weave(Pattern=graft(equals.Equality), Stream0=number_slider_9, Stream1=number_slider_8, NullGaps=False)  # -> flatten(Weave)
bending_normal = BendingAndNormalForcesGeneral(
    Nd=b_forces.NormalForce_kN,
    Myd=b_forces.BendingMomentMy_kNm,
    Mzd=0,
    Base=graft(weave),
    Heigth=graft(weave_2),
    BucklingLengthY=0,
    BucklingLengthZ=0,
    EffectiveLengthAsARatioOfTheSpan=1,
    ModificationFactor=0.6,
    Material=type)  # -> UtilY, UtilZ, Info
sort = SortList(Keys=bending_normal.UtilZ)  # -> reverse(Keys), ValuesA
sort_2 = SortList(Keys=bending_normal.UtilY)  # -> reverse(Keys), ValuesA
multiplication_4 = Multiplication(A=weave_2, B=weave)
item_8 = ListItem(List=sort_2.Keys, Index=0, Wrap=True)  # -> flatten(Item)
item_9 = ListItem(List=sort.Keys, Index=0, Wrap=True)  # -> flatten(Item)
multiplication_5 = Multiplication(A="403", B=multiplication_4)
max = Maximum(A=item_8, B=item_9)
division_7 = Division(A=multiplication_5, B="10000")
smaller_3 = SmallerThan(FirstNumber=max, SecondNumber="1.0")  # -> SmallerThan, OrEqualTo
p_n_c = PickNChoose(Pattern=smaller_3.SmallerThan, Stream0=addition_2, Stream1=repeat)
valid = ValidElements(Lines=disassemble_3.AxisOfElement, MinCrossSections=p_n_c, Stock=stock.Stock, mode="Steel")  # -> CrossSections, Weight
filter_4 = StreamFilter(Gate=larger_2.LargerThan, Stream0=valid.Weight, Stream1="0")
item_10 = ListItem(List=entwine_4, Index=valid.CrossSections, Wrap=True)
linetobeam_5 = LineToBeamKaramba3D(
    Line=disassemble_3.AxisOfElement,
    CrossSection=item_10,
    New=True,
    Remove=True,
    LimitDistance_m=0.005,
    Bending=True,
    SetBucklingLength=True,
    ToPolylineMaxAngle=0.03,
    ToPolylineTolerance=0.01,
    ToPolylineMinEdgeLength=0.25)  # -> Element, Points, Info
assemble_3 = AssembleModelKaramba3D(Elem=linetobeam_5.Element, LimitDistance_m=0.005)  # -> Model, Info, Mass_kg, CenterOfGravity, LoadCaseNames
modelview_3 = ModelViewKaramba3D(Model=assemble_3.Model, ResultFactors=1, ResultCase=-1)  # -> Model, DeformedMesh, DeformedAxes, DeformedModel
beamview_3 = BeamViewKaramba3D(Model=modelview_3.Model)  # -> Model, MeshesOfRenderedBeams, DeformedBeamAxes, LegendColors, LegendTags
# Weld beam meshes has to be sedt to FALSE in the ini file of Karamba3d
# Check that karamba setting weld meshes is set to false?
beamview_4 = BeamViewKaramba3D(Model=modelview_3.Model)  # -> Model, MeshesOfRenderedBeams, DeformedBeamAxes, LegendColors, LegendTags
disassemble_5 = DisassembleModelKaramba3D(Model=assemble_3.Model)  # -> Model, Point, Beam, Shell, Support, Load, Line, Mesh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
disassemble_6 = DisassembleElementKaramba3D(Element=disassemble_5.Beam)  # -> Element, ElementIdentifier, AxisOfElement, CrossSection, Joint, Material, LocalCoordinateSystem, ElementIsActive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
faceb = FaceBoundaries(Mesh=beamview_4.MeshesOfRenderedBeams)
disassemble_7 = DisassembleCrossSectionKaramba3D(CroSec=disassemble_6.CrossSection)  # -> CrossSection, FamilyNameOfCrossSection, TypeNameOfCrossSection, ElemIdentifiers, Color, Material, LocalEccentricity_cm, Heights_cm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
srf = Surface(faceb)
join = BrepJoin(Breps=srf)  # -> Breps, Closed
len_5 = Length(Curve=disassemble_6.AxisOfElement)
division_8 = Division(A=disassemble_7.Area_cm2, B="10000")
multiplication_6 = Multiplication(A=len_5, B=division_8)
join_2 = BrepJoin(Breps=join.Breps)  # -> Breps, Closed
item_11 = ListItem(List=join_2.Breps, Index=0, Wrap=True)  # -> flatten(Item)
kgco2e_m_5 = Panel(division_7)
smaller_4 = SmallerThan(FirstNumber=valid.CrossSections, SecondNumber="1")  # -> SmallerThan, OrEqualTo
lca_profile = SelectLCAProfile(
    SearchProfile="glulam",
    menu=[dropdown(None), dropdown(None), dropdown(None), dropdown(None), dropdown(None), dropdown(None), checkbox(off)])
lca_profile_2 = SelectLCAProfile(
    SearchProfile="S355",
    menu=[dropdown(None), dropdown(None), dropdown(None), dropdown(None), dropdown(None), dropdown(None), checkbox(off)])
weave_3 = Weave(Pattern=graft(smaller_4.SmallerThan), Stream0=lca_profile_2, Stream1=lca_profile, NullGaps=False)  # -> flatten(Weave)
material = DefineMaterial(LCAProfile=weave_3, Geometry=item_11, SetQuantity=multiplication_6, mode="SI", menu=[dropdown(None)])
lng_7 = ListLength(List=material)  # -> expr("x-1", Length)
range_3 = Range(Domain=lng_7, Steps=lng_7)
construction = CreateConstruction(Material=graft(material), Comment=graft(range_3), menu=[dropdown(None)])  # -> flatten(Construction)
lca = RunLCA(Construction=construction, RunLCA=Toggle(True), Login=Button(), RunInCloud=Toggle(False))  # -> Construction, KgCO2e
panel_12 = Panel(lca.KgCO2e)
num_2 = Number(flatten(lca.KgCO2e))
expression_2 = Expression(
    co2=num_2,
    lUtilErr=filter_3,
    lNerr=multiplication,
    err=expression,
    neg="-0.02",
    factor=Slider(10, range=0..10),
    Expression="factor*if(err=1,neg*lNerr,(1-(co2/10000)+neg*lUtilErr))")
num_3 = Number(expression_2)
results = VisualizeResults(
    Construction=lca.Construction,
    menu=[slider(0.23), buttons(off, off, off, on, off, off, off, off, off, off, off), dropdown(None), dropdown(None), slider(0), slider(100), buttons(off, on, off, off, off, off)])

# ==== cluster Cluster
pt = ClusterInput()
pt_2 = Point(pt)
panel = Panel("""-1
-2""")
shift = ShiftList(List=pt_2, Shift=1, Wrap=False)
shift_2 = ShiftList(List=pt_2, Shift="2", Wrap=False)
item = ListItem(List=pt_2, Index="-1", Wrap=True)  # -> Item1, Item
cull_i = CullIndex(List=pt_2, Indices=panel, Wrap=True)
cull_i_2 = CullIndex(List=shift, Indices="-1", Wrap=True)
ln = Line(StartPoint=cull_i, EndPoint=cull_i_2)
ln_2 = Line(StartPoint=cull_i, EndPoint=shift_2)
ln_3 = Line(StartPoint=item.Item1, EndPoint=item.Item)
crv = Curve(flatten([ln_3, ln_2, ln]))
crv_2 = ClusterOutput(crv)
